# Grasshopper definition 0820.gh (Grasshopper 1.0.5)

number_slider = Slider(18, range=1..200)
panel = Panel("length")
panel_2 = Panel("step")
panel_3 = Panel("height")
gene_pool = GenePool(Decimals=2, Maximum=2, Minimum=0, Value=[0.1, 0.19, 0.22])
gene_pool_2 = GenePool(Decimals=0, Maximum=50, Minimum=5, Value=[35, 38, 32])
gene_pool_3 = GenePool(Decimals=0, Maximum=50, Minimum=-50, Value=[0, 32, 50])
ghpython_script = GhPythonScript(x=gene_pool_2, y=gene_pool, z=gene_pool_3)  # -> out, a; inputs x: list, y: list, z: list
# ---------- ghpython_script: Python ----------
import rhinoscriptsyntax as rs
import math
import Rhino.Geometry as rg

a=[]
b=[]
rad=0
st=math.pi*2/100
r=5
i=1
ori=rg.Point3d(0,200,0)

#ln=[50,30,60]
ln=x
crad=[0,0,0]
#sts=[st,st*2,st/0.7]
sts=y
hi=z

#for i in range(100):
#    rad=i*st
#    xx=math.cos(i*st)*r
#    yy=math.sin(i*st)*r
#    if i==25:
#        r=r*2
#        ori=rg.Point3d.Divide a[i-1]
#    if i==50:
#        r=r*2
#        ori=a[i-1]
#    if i==75:
#        r=r*2
#        ori=a[i-1]
#    a.append(rg.Point3d(xx,yy,0))
#    b.append(rg.Line(a[i],ori))
    
def addMyLine(opt,rad,r):
    mov=rg.Vector3d(math.cos(rad)*r,math.sin(rad)*r,0)
    end=rg.Point3d.Add(opt,mov)
    return rg.Line(opt,end)

def chain(opt,lens):
    reline=[]
    global crad
    global hi
    for i in range(len(crad)):
        crad[i]=crad[i]+sts[i]
    
    for i in range(len(lens)):
        nl=addMyLine(opt,crad[i],lens[i])
        reline.append(nl)
        opt=nl.To
    
    return reline

for i in range(100):
    b.append(addMyLine(ori,i*st,r))
    a.extend(chain(ori,ln))
# ---------- end ghpython_script ----------
ghpython_script_2 = GhPythonScript(x=gene_pool_2, y=gene_pool, z=gene_pool_3)  # -> out, a; inputs x: list, y: list, z: list
# ---------- ghpython_script_2: Python ----------
import rhinoscriptsyntax as rs
import math
import Rhino.Geometry as rg

a=[]
b=[]
rad=0
st=math.pi*2/100
r=5
i=1
ori=rg.Point3d(-200,0,0)

#ln=[50,30,60]
ln=x
crad=[0,0,0]
#sts=[st,st*2,st/0.7]
sts=y
hi=z

#for i in range(100):
#    rad=i*st
#    xx=math.cos(i*st)*r
#    yy=math.sin(i*st)*r
#    if i==25:
#        r=r*2
#        ori=rg.Point3d.Divide a[i-1]
#    if i==50:
#        r=r*2
#        ori=a[i-1]
#    if i==75:
#        r=r*2
#        ori=a[i-1]
#    a.append(rg.Point3d(xx,yy,0))
#    b.append(rg.Line(a[i],ori))
    
def addMyLine(opt,rad,r,h):
    mov=rg.Vector3d(math.cos(rad)*r,math.sin(rad)*r,max(z)*math.sin(h/30)*0.7)
    end=rg.Point3d.Add(opt,mov)
    return rg.Line(opt,end)

def chain(opt,lens,k):
    reline=[]
    global crad
    global hi
    for i in range(len(crad)):
        crad[i]=crad[i]+sts[i]
    
    for i in range(len(lens)):
        nl=addMyLine(opt,crad[i],lens[i],k)
        reline.append(nl)
        opt=nl.To
    
    return reline

for i in range(100):
    b.append(addMyLine(ori,i*st,r,i))
    a.extend(chain(ori,ln,i))
# ---------- end ghpython_script_2 ----------
ghpython_script_3 = GhPythonScript(x=gene_pool_2, y=gene_pool, z=gene_pool_3)  # -> out, a; inputs x: list, y: list, z: list
# ---------- ghpython_script_3: Python ----------
import rhinoscriptsyntax as rs
import math
import Rhino.Geometry as rg

a=[]
b=[]
rad=0
st=math.pi*2/100
r=5
i=1
ori=rg.Point3d.Origin

#ln=[50,30,60]
ln=x
crad=[0,0,0]
#sts=[st,st*2,st/0.7]
sts=y
hi=z

#for i in range(100):
#    rad=i*st
#    xx=math.cos(i*st)*r
#    yy=math.sin(i*st)*r
#    if i==25:
#        r=r*2
#        ori=rg.Point3d.Divide a[i-1]
#    if i==50:
#        r=r*2
#        ori=a[i-1]
#    if i==75:
#        r=r*2
#        ori=a[i-1]
#    a.append(rg.Point3d(xx,yy,0))
#    b.append(rg.Line(a[i],ori))
    
def addMyLine(opt,rad,r,h):
    mov=rg.Vector3d(math.cos(rad)*r,math.sin(rad)*r,h)
    end=rg.Point3d.Add(opt,mov)
    return rg.Line(opt,end)

def chain(opt,lens):
    reline=[]
    global crad
    global hi
    for i in range(len(crad)):
        crad[i]=crad[i]+sts[i]
    
    for i in range(len(lens)):
        nl=addMyLine(opt,crad[i],lens[i],hi[i])
        reline.append(nl)
        opt=nl.To
    
    return reline

for i in range(100):
    b.append(addMyLine(ori,i*st,r,i))
    a.extend(chain(ori,ln))
# ---------- end ghpython_script_3 ----------
ghpython_script_4 = GhPythonScript(x=gene_pool_2, y=gene_pool, z=gene_pool_3)  # -> out, a; inputs x: list, y: list, z: list
# ---------- ghpython_script_4: Python ----------
import rhinoscriptsyntax as rs
import math
import Rhino.Geometry as rg

a=[]
b=[]
rad=0
st=math.pi*2/100
r=5
i=1
ori=rg.Point3d(200,0,0)

#ln=[50,30,60]
ln=x
crad=[0,0,0]
#sts=[st,st*2,st/0.7]
sts=y
hi=z

#for i in range(100):
#    rad=i*st
#    xx=math.cos(i*st)*r
#    yy=math.sin(i*st)*r
#    if i==25:
#        r=r*2
#        ori=rg.Point3d.Divide a[i-1]
#    if i==50:
#        r=r*2
#        ori=a[i-1]
#    if i==75:
#        r=r*2
#        ori=a[i-1]
#    a.append(rg.Point3d(xx,yy,0))
#    b.append(rg.Line(a[i],ori))
    
def addMyLine(opt,rad,r,h):
    mov=rg.Vector3d(math.cos(rad)*r,math.sin(rad)*r,h*max(math.sin(rad),math.cos(rad)))
    end=rg.Point3d.Add(opt,mov)
    return rg.Line(opt,end)

def chain(opt,lens):
    reline=[]
    global crad
    global hi
    for i in range(len(crad)):
        crad[i]=crad[i]+sts[i]
    
    for i in range(len(lens)):
        nl=addMyLine(opt,crad[i],lens[i],hi[i])
        reline.append(nl)
        opt=nl.To
    
    return reline

for i in range(100):
    b.append(addMyLine(ori,i*st,r,i))
    a.extend(chain(ori,ln))
# ---------- end ghpython_script_4 ----------
ghpython_script_5 = GhPythonScript(x=gene_pool_2, y=gene_pool, z=gene_pool_3, u=number_slider)  # -> out, a; inputs x: list, y: list, z: list
# ---------- ghpython_script_5: Python ----------
import rhinoscriptsyntax as rs
import math
import Rhino.Geometry as rg

a=[]
b=[]
rad=0
st=math.pi*2/100
r=5
i=1
ori=rg.Point3d(-200,-200,0)

#ln=[50,30,60]
ln=x
crad=[0,0,0]
#sts=[st,st*2,st/0.7]
sts=y
hi=z

#for i in range(100):
#    rad=i*st
#    xx=math.cos(i*st)*r
#    yy=math.sin(i*st)*r
#    if i==25:
#        r=r*2
#        ori=rg.Point3d.Divide a[i-1]
#    if i==50:
#        r=r*2
#        ori=a[i-1]
#    if i==75:
#        r=r*2
#        ori=a[i-1]
#    a.append(rg.Point3d(xx,yy,0))
#    b.append(rg.Line(a[i],ori))
    
def addMyLine(opt,rad,r,h):
    mov=rg.Vector3d(math.cos(rad)*r,math.sin(rad)*r,max(z)*math.sin(h/u))
    end=rg.Point3d.Add(opt,mov)
    return rg.Line(opt,end)

def chain(opt,lens,k):
    reline=[]
    global crad
    global hi
    for i in range(len(crad)):
        crad[i]=crad[i]+sts[i]
    
    for i in range(len(lens)):
        nl=addMyLine(opt,crad[i],lens[i],k)
        reline.append(nl)
        opt=nl.To
    
    return reline

for i in range(100):
    b.append(addMyLine(ori,i*st,r,i))
    a.extend(chain(ori,ln,i))
# ---------- end ghpython_script_5 ----------
ghpython_script_6 = GhPythonScript(x=gene_pool_2, y=gene_pool, z=Slider(4.982, range=1..10), u=number_slider)  # -> out, a; inputs x: list, y: list
# ---------- ghpython_script_6: Python ----------
import rhinoscriptsyntax as rs
import math
import Rhino.Geometry as rg

a=[]
b=[]
rad=0
st=math.pi*2/100
r=5
i=1
ori=rg.Point3d(-200,-400,0)

#ln=[50,30,60]
ln=x
crad=[0,0,0]
#sts=[st,st*2,st/0.7]
sts=y

#for i in range(100):
#    rad=i*st
#    xx=math.cos(i*st)*r
#    yy=math.sin(i*st)*r
#    if i==25:
#        r=r*2
#        ori=rg.Point3d.Divide a[i-1]
#    if i==50:
#        r=r*2
#        ori=a[i-1]
#    if i==75:
#        r=r*2
#        ori=a[i-1]
#    a.append(rg.Point3d(xx,yy,0))
#    b.append(rg.Line(a[i],ori))
    
def addMyLine(opt,rad,r,h,k):
    t=math.sin(h/u)*(z*0.2+k)*20
    mov=rg.Vector3d(math.cos(rad)*r,math.sin(rad)*r,t)
    end=rg.Point3d.Add(opt,mov)
    return rg.Line(opt,end)

def chain(opt,lens,k):
    reline=[]
    global crad
    global hi
    for i in range(len(crad)):
        crad[i]=crad[i]+sts[i]
    
    for i in range(len(lens)):
        nl=addMyLine(opt,crad[i],lens[i],k,i)
        reline.append(nl)
        opt=nl.To
    
    return reline

for i in range(100):
#    b.append(addMyLine(ori,i*st,r,i))
    a.extend(chain(ori,ln,i))
# ---------- end ghpython_script_6 ----------

split_list = SplitList(List=ghpython_script_2.a, Index=299)  # -> ListA, ListB; disabled
shift_list = ShiftList(List=ghpython_script_2.a, Shift=2, Wrap=True)  # disabled
shift_list_2 = ShiftList(List=split_list.ListA, Shift=3, Wrap=True)  # disabled
ruled_surface = RuledSurface(CurveA=shift_list, CurveB=ghpython_script_2.a)  # disabled
ruled_surface_2 = RuledSurface(CurveA=shift_list_2, CurveB=split_list.ListA)  # disabled

split_list_2 = SplitList(List=ghpython_script_3.a, Index=299)  # -> ListA, ListB
shift_list_3 = ShiftList(List=ghpython_script_3.a, Shift=1, Wrap=True)
shift_list_4 = ShiftList(List=split_list_2.ListA, Shift=3, Wrap=True)
ruled_surface_3 = RuledSurface(CurveA=shift_list_4, CurveB=split_list_2.ListA)
ruled_surface_4 = RuledSurface(CurveA=shift_list_3, CurveB=ghpython_script_3.a)

split_list_3 = SplitList(List=ghpython_script_4.a, Index=299)  # -> ListA, ListB; disabled
shift_list_5 = ShiftList(List=ghpython_script_4.a, Shift=1, Wrap=True)  # disabled
shift_list_6 = ShiftList(List=split_list_3.ListA, Shift=3, Wrap=True)  # disabled
ruled_surface_5 = RuledSurface(CurveA=shift_list_5, CurveB=ghpython_script_4.a)  # disabled
ruled_surface_6 = RuledSurface(CurveA=shift_list_6, CurveB=split_list_3.ListA)  # disabled

split_list_4 = SplitList(List=ghpython_script_5.a, Index=299)  # -> ListA, ListB; disabled
shift_list_7 = ShiftList(List=ghpython_script_5.a, Shift=1, Wrap=True)  # disabled
shift_list_8 = ShiftList(List=split_list_4.ListA, Shift=3, Wrap=True)  # disabled
ruled_surface_7 = RuledSurface(CurveA=shift_list_7, CurveB=ghpython_script_5.a)  # disabled
ruled_surface_8 = RuledSurface(CurveA=shift_list_8, CurveB=split_list_4.ListA)  # disabled

split_list_5 = SplitList(List=ghpython_script_6.a, Index=299)  # -> ListA, ListB; disabled
shift_list_9 = ShiftList(List=ghpython_script_6.a, Shift=1, Wrap=True)  # disabled
shift_list_10 = ShiftList(List=split_list_5.ListA, Shift=3, Wrap=True)  # disabled
ruled_surface_9 = RuledSurface(CurveA=shift_list_9, CurveB=ghpython_script_6.a)  # disabled
ruled_surface_10 = RuledSurface(CurveA=shift_list_10, CurveB=split_list_5.ListA)  # disabled
