# Grasshopper definition 0821.gh (Grasshopper 1.0.5)
# plug-ins: Karamba, Weaverbird

gene_pool = GenePool(Decimals=0, Maximum=200, Minimum=0, Value=[100, 100, 100])
ghpython_script = GhPythonScript(z=gene_pool, x=Slider(0.001, range=0..0.1), y=Slider(0.05, range=0..0.2))  # -> out, a; inputs z: list of Int32
# ---------- ghpython_script: Python ----------
import rhinoscriptsyntax as rs
import Rhino.Geometry as rg
import math

a=[]

for i in range(z[0]):
    for k in range(z[1]):
        for j in range(z[2]):
            q=math.sin(y*i)*math.cos(y*k)
            w=math.sin(y*k)*math.cos(y*j)
            e=math.sin(y*j)*math.cos(y*i)
            if (q+w+e<=x)and(q+w+e>=-x):
                a.append(rg.Point3d(i,k,j))
# ---------- end ghpython_script ----------
ghpython_script_2 = GhPythonScript(z=gene_pool, y=Slider(5, range=0..100))  # -> out, a; inputs z: list of Int32; disabled
# ---------- ghpython_script_2: Python ----------
import rhinoscriptsyntax as rs
import Rhino.Geometry as rg
import math

a=[]
h=0

for i in range(z[0]):
    for k in range(z[1]):
        tmp=h*math.sin(z[0]*math.pi)
        if ((i+z[0]/2)**2+(k+z[0]/2)**2==z[0]**2):
            a.append(rg.Point3d(i,k,h))
        if k==z[1]-1 :
            h=h+y
# ---------- end ghpython_script_2 ----------
point = Point(ghpython_script.a)
remove_duplicate_points_karamba = RemoveDuplicatePointsKaramba(Point=point, LimitDistance=Slider(61, range=0..100))  # -> OutPoint, Info, Indexes

circle_fit = CircleFit(Points=point)  # -> Circle, Radius, Deviation; disabled
curve_closest_point = CurveClosestPoint(Point=point, Curve=circle_fit.Circle)  # -> Point, Parameter, Distance; disabled
sort_list = SortList(Keys=curve_closest_point.Distance, ValuesValuesA=curve_closest_point.Point)  # -> Keys, ValuesValuesA; disabled
closest_points = ClosestPoints(Point=sort_list.ValuesValuesA, Cloud=point, Count=3)  # -> ClosestPoint, CPIndex, Distance; disabled

facet_dome = FacetDome(Points=remove_duplicate_points_karamba.OutPoint)  # -> Pattern, Dome
evaluate_box = EvaluateBox(Box=facet_dome.Dome, UParameter=0.5, VParameter=0.5, WParameter=0.5)  # -> Plane, Point, Include
number_slider = Slider(1.3, range=0.5..1.5)
scale = Scale(Geometry=remove_duplicate_points_karamba.OutPoint, Center=evaluate_box.Point, Factor=number_slider)  # -> Geometry, Transform
facet_dome_2 = FacetDome(Points=scale.Geometry)  # -> Pattern, Dome
explode = Explode(Curve=facet_dome.Pattern, Recursive=True)  # -> flatten(Segments), Vertices
explode_2 = Explode(Curve=facet_dome_2.Pattern, Recursive=True)  # -> flatten(Segments), Vertices
end_points = EndPoints(Curve=explode.Segments)  # -> Start, End
gene_pool_2 = GenePool(Decimals=1, Maximum=1, Minimum=0, Value=[0.8, 0.6, 0.35, 0.6, 0.8])
gene_pool_3 = GenePool(Decimals=1, Maximum=5, Minimum=2, Value=[5, 5, 5, 5, 5])
remove_duplicate_points_karamba_2 = RemoveDuplicatePointsKaramba(Point=[end_points.Start, end_points.End], LimitDistance=Slider(11, range=0..50))  # -> OutPoint, Info, Indexes
create_set = CreateSet(List=remove_duplicate_points_karamba_2.OutPoint)  # -> Set, Map
scale_2 = Scale(Geometry=create_set.Set, Center=evaluate_box.Point, Factor=number_slider)  # -> Geometry, Transform
number_slider_2 = Slider(8, range=0..10)
line = Line(StartPoint=create_set.Set, EndPoint=scale_2.Geometry)
pipe = Pipe(Curve=line, Radius=number_slider_2, Caps=0)  # disabled
pipe_2 = Pipe(Curve=explode_2.Segments, Radius=number_slider_2, Caps=0)  # disabled

curve = Curve(facet_dome.Pattern)
curve_2 = Curve(facet_dome_2.Pattern)
number_slider_3 = Slider(1, range=0..3)
number_slider_4 = Slider(2, range=0..3)
weaverbird_s_split_polygons_subdivision = WeaverbirdsSplitPolygonsSubdivision(MeshCurves=curve_2, Level=Slider(0, range=0..3), SmoothNakedEdges=number_slider_4)
weaverbird_s_picture_frame = WeaverbirdsPictureFrame(MeshPolylines=weaverbird_s_split_polygons_subdivision, Distance=Slider(4.5, range=0..5), InsetType=1)
weaverbird_s_picture_frame_2 = WeaverbirdsPictureFrame(MeshPolylines=curve, Distance=Slider(2, range=0..2), InsetType=1)
weaverbird_s_mesh_thicken = WeaverbirdsMeshThicken(MeshCurves=weaverbird_s_picture_frame, Distance=Slider(5, range=0..5), OffsetType=0)
weaverbird_s_mesh_thicken_2 = WeaverbirdsMeshThicken(MeshCurves=weaverbird_s_picture_frame_2, Distance=Slider(4, range=0..5), OffsetType=0)
pipe_3 = Pipe(Curve=line, Radius=Slider(2.5, range=0..3), Caps=1)

weaverbird_s_midedge_subdivision = WeaverbirdsMidedgeSubdivision(MeshCurves=weaverbird_s_split_polygons_subdivision, Level=number_slider_3, SmoothNakedEdges=number_slider_4)
weaverbird_s_midedge_subdivision_2 = WeaverbirdsMidedgeSubdivision(MeshCurves=weaverbird_s_midedge_subdivision, Level=number_slider_3, SmoothNakedEdges=number_slider_4)

weaverbird_s_picture_frame_3 = WeaverbirdsPictureFrame(MeshPolylines=weaverbird_s_midedge_subdivision, Distance=Slider(3, range=0..5), InsetType=1)
weaverbird_s_picture_frame_4 = WeaverbirdsPictureFrame(MeshPolylines=weaverbird_s_midedge_subdivision_2, Distance=Slider(2.5, range=0..5), InsetType=1)
weaverbird_s_mesh_thicken_3 = WeaverbirdsMeshThicken(MeshCurves=weaverbird_s_picture_frame_3, Distance=Slider(4.5, range=0..5), OffsetType=0)
weaverbird_s_mesh_thicken_4 = WeaverbirdsMeshThicken(MeshCurves=weaverbird_s_picture_frame_4, Distance=Slider(3.8, range=0..5), OffsetType=0)

pipe_4 = Pipe(Curve=curve, Radius=number_slider_2, Caps=0)  # disabled
mesh = Mesh([pipe, pipe_4, pipe_2])  # disabled
