# Grasshopper definition 0828-1.gh (Grasshopper 1.0.5)
# plug-ins: Weaverbird

curve = Curve([<curve referenced from the Rhino model> x2])

number_slider = Slider(10, range=0..100)

integer_division = IntegerDivision(A=100, B=number_slider)

square = Square(Plane=PlaneXY(0, 0, 0), Size=number_slider, ExtentX=integer_division, ExtentY=integer_division)  # -> Cells, Points

curve_closest_point = CurveClosestPoint(Point=square.Points, Curve=curve)  # -> Point, Parameter, Distance
division = Division(A=curve_closest_point.Distance, B=Slider(13, range=0..30))
multiplication = Multiplication(A=integer_division, B=Slider(0.436, range=0..1))

polygon = Polygon(Plane=square.Points, Radius=multiplication, Segments=Slider(6, range=0..20), FilletRadius=0)  # -> Polygon, Length

scale = Scale(Geometry=polygon.Polygon, Center=square.Points, Factor=division)  # -> Geometry, Transform
unit_z = UnitZ(Factor=scale.Geometry)
multiplication_2 = Multiplication(A=unit_z, B=Slider(0.472, range=0..4))
graph_mapper = GraphMapper(
    multiplication_2,
    x0=0,
    x1=1000,
    y0=0,
    y1=1500,
    container_name="Bezier",
    cpx=[0, 0.3493864536, 0.5169217587, 1],
    cpy=[0, 0.2910682559, 0.3329524994, 0.08279240131])
move = Move(Geometry=scale.Geometry, Motion=graph_mapper)  # -> Geometry, Transform
extrude = Extrude(Base=scale.Geometry, Direction=graph_mapper)  # -> flatten(Extrusion)
boundary_surfaces = BoundarySurfaces(Edges=move.Geometry)
mesh = Mesh(extrude)
weaverbird_s_picture_frame = WeaverbirdsPictureFrame(MeshPolylines=mesh, Distance=2, InsetType=1)
weaverbird_s_mesh_thicken = WeaverbirdsMeshThicken(MeshCurves=weaverbird_s_picture_frame, Distance=3, OffsetType=0)
