# Grasshopper definition 0828.gh (Grasshopper 1.0.5)

surface = Surface([<surface referenced from the Rhino model> x3])
populate_geometry = PopulateGeometry(Geometry=surface, Count=Slider(50, range=0..50), Seed=Slider(21, range=0..50))
curve = Curve()
timer = Timer(TimerInterval=200, Target=c_script)
ghpython_script = GhPythonScript(x=populate_geometry, y=curve, z=Slider(29, range=0..50))  # -> out, a; inputs x: list, y: list, z: Int32
# ---------- ghpython_script: Python ----------
import rhinoscriptsyntax as rs

cl=[]

class cir:
    def __init__(self,cent,bound):
        self.cent=cent
        self.rad=1
        self.bound=bound
        self.growg=True
    
    def disp(self):
        circ=rs.AddCircle(self.cent,self.rad)
        return circ
    
    def grow(self):
        if(self.growg):
            self.rad+=1
    
    def edge(self):
        tmp=0
        for i in range(len(self.bound)):
            rest=rs.CurveCurveIntersection(self.disp(),self.bound[i])
            if(rest!=None):
                tmp+=1
            if(tmp==0):
                return False
            else:
                return True
        


for i in range(len(x)):
    c=cir(x[i],y)
    cl.append(c)

    
timelist=[]
for i in range(z):
    clist=[]
    for c in cl:
        if (c.growg):
            if (c.edge()):
                c.grow=False
                break
            else:
                for other in cl:
                    if (c!=other):
                        d=rs.Distance(c.cent,other.cent)
                        if (d<c.rad+other.rad):
                            c.growg=False
                            break
        print c.growg
        c.grow()
        circ=c.disp()
        clist.append(circ)
    timelist.append(clist)

a=timelist
# ---------- end ghpython_script ----------
ghpython_script_2 = GhPythonScript(x=ghpython_script.a)  # -> out, simplify(a)
# ---------- ghpython_script_2: Python ----------
import rhinoscriptsyntax as rs
import collections

xIsList=isinstance(x,collections.Iterable)

if(xIsList):
    a=x
else:
    a=[x]
# ---------- end ghpython_script_2 ----------
c_script = CSharpScript(x=Toggle(True))  # -> out, A; inputs x: Boolean
# ---------- c_script: C# ----------
    if(x)
    {
      y =y + 1;
    }
    A = y;
# ---------- c_script: C# additional code ----------
  y=0
# ---------- end c_script ----------
tree_statistics = TreeStatistics(Tree=ghpython_script_2.a)  # -> Paths, Length, Count
list_length = ListLength(List=tree_statistics.Paths)
subtraction = Subtraction(A=list_length, B=Slider(1000, range=0..1000))
list_item = ListItem(List=tree_statistics.Paths, Index=subtraction, Wrap=True)
tree_branch = TreeBranch(Tree=ghpython_script_2.a, Path=list_item, MaintainPaths=True)
