# Grasshopper definition 0829-1.gh (Grasshopper 1.0.5)
# plug-ins: Karamba

gene_pool = GenePool(Decimals=0, Maximum=200, Minimum=0, Value=[200, 200, 200])
ghpython_script = GhPythonScript(z=gene_pool, x=Slider(0.03, range=0..0.1), y=Slider(0.02, range=0..0.2))  # -> out, a; inputs z: list of Int32
# ---------- ghpython_script: Python ----------
import rhinoscriptsyntax as rs
import Rhino.Geometry as rg
import math

a=[]

for i in range(z[0]):
    for k in range(z[1]):
        for j in range(z[2]):
            q=math.sin(y*i)*math.cos(y*k)
            w=math.sin(y*k)*math.cos(y*j)
            e=math.sin(y*j)*math.cos(y*i)
            if (q+w+e<=x)and(q+w+e>=-x):
                a.append(rg.Point3d(i,k,j))
# ---------- end ghpython_script ----------
remove_duplicate_points_karamba = RemoveDuplicatePointsKaramba(Point=ghpython_script.a, LimitDistance=Slider(8, range=0..10))  # -> OutPoint, Info, Indexes
proximity_3d = Proximity3D(Group=5, MinRadius=Slider(1, range=0..10), MaxRadius=Slider(11, range=0..100))  # -> Links, Topology
proximity_3d_2 = Proximity3D(Group=5)  # -> Links, Topology
delaunay_edges = DelaunayEdges(Plane=PlaneXY(0, 0, 0))  # -> Connectivity, Edges
voronoi = Voronoi(BruteForceOverride=False)
