# Grasshopper definition 0829.gh (Grasshopper 1.0.5)

square = Square(Plane=PlaneXY(0, 0, 0), Size=10, ExtentX=20, ExtentY=20)  # -> Cells, Points
control_polygon = ControlPolygon(Curve=square.Cells)  # -> Polygon, Points
number_slider = Slider(5, range=0..5)
list_item = ListItem(List=control_polygon.Points, Index=0, Wrap=True)  # -> Item, Item1, Item2, Item3
area = Area(Geometry=square.Cells)  # -> Area, Centroid
arc = Arc(Plane=list_item.Item, Radius=number_slider, Angle=Domain(0, 1.570796327))  # -> Arc, Length
arc_2 = Arc(Plane=list_item.Item2, Radius=number_slider, Angle=Domain(3.141592654, 4.71238898))  # -> Arc, Length
graft_tree = GraftTree(Tree=area.Centroid, IncludeEmptyLists=True, IncludeNullItems=True)
line = Line(StartPoint=list_item.Item, EndPoint=list_item.Item2)
divide_curve = DivideCurve(Curve=line, Count=2, Kinks=False)  # -> Points, Tangents, Parameters
dispatch = Dispatch(List=divide_curve.Points, DispatchPattern=[False, True, False])  # -> ListA, ListB
curve = Curve([arc.Arc, arc_2.Arc])
point = Point(dispatch.ListA)
tree_statistics = TreeStatistics(Tree=curve)  # -> Paths, Length, Count
unit_z = UnitZ(Factor=0.5)
random = Random(Range=Domain(0, 3), Number=tree_statistics.Count, Seed=2)
simplify_tree = SimplifyTree(Tree=list_item.Item1, Front=False)
simplify_tree_2 = SimplifyTree(Tree=list_item.Item3, Front=False)
integer = Integer(random)
move = Move(Geometry=point, Motion=unit_z)  # -> simplify(Geometry), Transform
multiplication = Multiplication(A=integer, B=1.570796327)
graft_tree_2 = GraftTree(Tree=multiplication, IncludeEmptyLists=True, IncludeNullItems=True)
interpolate = Interpolate(Vertices=[simplify_tree, move.Geometry, simplify_tree_2], Degree=3, Periodic=False, KnotStyle=1)  # -> Curve, Length, Domain
rotate = Rotate(Geometry=interpolate.Curve, Angle=graft_tree_2, Plane=graft_tree)  # -> Geometry, Transform
rotate_2 = Rotate(Geometry=curve, Angle=graft_tree_2, Plane=graft_tree)  # -> Geometry, Transform
unit_z_2 = UnitZ(Factor=1)
list_item_2 = ListItem(List=rotate_2.Geometry, Index=0, Wrap=True)  # -> Item, Item1, Item2, Item3
move_2 = Move(Geometry=[rotate_2.Geometry, rotate.Geometry], Motion=unit_z_2)  # -> Geometry, Transform
control_polygon_2 = ControlPolygon(Curve=list_item_2.Item3)  # -> Polygon, Points
list_item_3 = ListItem(List=move_2.Geometry, Index=0, Wrap=True)  # -> Item, Item1, Item2
end_points = EndPoints(Curve=[list_item_3.Item, list_item_3.Item1])  # -> Start, End
list_item_4 = ListItem(List=control_polygon_2.Points, Index=0, Wrap=True)  # -> Item, Item1, Item2, Item3
list_item_5 = ListItem(List=[end_points.Start, end_points.End], Index=0, Wrap=True)  # -> Item, Item1, Item2, Item3
flip_curve = FlipCurve(Curve=list_item_3.Item1)  # -> Curve, Flag
deconstruct_arc = DeconstructArc(Arc=[list_item_3.Item, list_item_3.Item1])  # -> BasePlane, Radius, Angle
move_3 = Move(Geometry=deconstruct_arc.BasePlane, Motion=expr("-x", unit_z_2))  # -> Geometry, Transform
loft = Loft(
    Curves=[list_item_3.Item, list_item_3.Item2],
    Options={Adjust=False, Closed=False, LoftEnds=0, LoftSimp=0, LoftType=0, Rebuild=10, Refit=0.01})

_4point_surface = _4PointSurface(CornerA=list_item_4.Item2, CornerB=list_item_5.Item1, CornerC=list_item_4.Item3)  # -> simplify(Surface)
_4point_surface_2 = _4PointSurface(CornerA=list_item_4.Item3, CornerB=list_item_5.Item2, CornerC=list_item_4.Item)  # -> simplify(Surface)
_4point_surface_3 = _4PointSurface(CornerA=list_item_4.Item, CornerB=list_item_5.Item, CornerC=list_item_4.Item1)  # -> simplify(Surface)
_4point_surface_4 = _4PointSurface(CornerA=list_item_4.Item1, CornerB=list_item_5.Item3, CornerC=list_item_4.Item2)  # -> simplify(Surface)

loft_2 = Loft(
    Curves=[flip_curve.Curve, list_item_3.Item2],
    Options={Adjust=False, Closed=False, LoftEnds=0, LoftSimp=0, LoftType=0, Rebuild=10, Refit=0.01})
extrude_point = ExtrudePoint(Base=[list_item_3.Item, list_item_3.Item1], Point=move_3.Geometry)
surface = Surface([loft, loft_2, _4point_surface_3, _4point_surface_4, _4point_surface, _4point_surface_2, extrude_point])
brep_join = BrepJoin(Breps=surface)  # -> Breps, Closed
substrate = Substrate(Border={Plane=PlaneXY(0, 0, 0), Size=Domain2(u=0..20, v=0..5)}, Count=100, Angles=[0.1, 0.3, 0.5], Deviation=0, Seed=5)
voronoi_groups = VoronoiGroups(Boundary={Plane=PlaneXY(0, 0, 0), Size=Domain2(u=-10..10, v=-10..10)})  # -> Diagram1, Diagram2
