# Grasshopper definition 0830-1.gh (Grasshopper 1.0.5)

gene_pool = GenePool(Decimals=0, Maximum=200, Minimum=0, Value=[200, 200, 200])
ghpython_script = GhPythonScript(
    z=gene_pool,
    x=Slider(0.02008, range=0..0.1),
    y=Slider(0.255, range=0..10),
    u=Slider(1, range=0..3),
    v=Slider(1, range=0..3))  # -> out, a; inputs z: list of Int32
# ---------- ghpython_script: Python ----------
import rhinoscriptsyntax as rs
import Rhino.Geometry as rg
import math

a=[]

for i in range(z[0]):
    for k in range(z[1]):
        for j in range(z[2]):
            q=i/y
            w=k/y
            e=j/y
            tmp=64*(e**9)-128*(e**7)+64*(e**5)-702*((q**2)*(w**2)*(e**3))-18*(q**2)*(w**2)*e+144*((w**2)*(e**6)-(q**2)*(e**6))+162*((w**4)*(e**2)-(q**4)*(e**2))+27*(w**6-q**6)+9*e*(q**4+w**4)+48*(e**3)*(q**2+w**2)-432*(e**5)*(q**2+w**2)+81*((w**2)*(q**4)+(q**2)*(w**4))+240*((w**2)*(e**4)-(q**2)*(e**4))-135*((q**4)*(e**3)+(w**4)*(e**3))
            if (tmp<=x)and(tmp>=-1*x):
                a.append(rg.Point3d(i,k,j))
                
            print tmp
# ---------- end ghpython_script ----------
point = Point(ghpython_script.a)
