# Grasshopper definition 0830.gh (Grasshopper 1.0.5)
# plug-ins: Weaverbird, Kangaroo2 Components

number_slider = Slider(0.95, range=0..1.2)

number_slider_2 = Slider(14, range=0..40)
circle = Circle(Plane=PlaneXY(0, 0, 90), Radius=50)
circle_2 = Circle(Plane=PlaneXY(0, 0, 0), Radius=30)
divide_curve = DivideCurve(Curve=circle, Count=number_slider_2, Kinks=False)  # -> Points, Tangents, Parameters
divide_curve_2 = DivideCurve(Curve=circle_2, Count=number_slider_2, Kinks=False)  # -> Points, Tangents, Parameters
random = Random(Range=Domain(40, 100), Number=5, Seed=Slider(19, range=0..50))
integer = Integer(random)
loft_options = LoftOptions(Closed=True, Adjust=True, Rebuild=20, Refit=0, Type=2)
number_slider_3 = Slider(30, range=1..150)
unit_z = UnitZ(Factor=95)
circle_3 = Circle(Plane=PlaneXY(0, 0, 0), Radius=Slider(15, range=0..30))

random_2 = Random(Range=Domain(-10, 10), Number=number_slider_2, Seed=Slider(11, range=0..50))
random_3 = Random(Range=Domain(-10, 10), Number=number_slider_2, Seed=Slider(19, range=0..50))
integer_2 = Integer(random_2)
integer_3 = Integer(random_3)
vector_xyz = VectorXYZ(XComponent=integer_2, YComponent=integer_3, ZComponent=0)  # -> Vector, Length
move = Move(Geometry=divide_curve.Points, Motion=vector_xyz.Vector)  # -> Geometry, Transform
interpolate = Interpolate(Vertices=move.Geometry, Degree=3, Periodic=True, KnotStyle=1)  # -> Curve, Length, Domain
line = Line(StartPoint=move.Geometry, EndPoint=divide_curve_2.Points)

loft = Loft(Curves=line, Options=loft_options)
mesh_surface = MeshSurface(Surface=loft, UCount=number_slider_3, VCount=Slider(4, range=1..20), Overhang=True, Equalize=False)

circle_4 = Circle(circle_2)
nakedvertices = NakedVertices(Mesh=mesh_surface)  # -> ClothedIndex, NakedIndex, ClothedPts, NakedPts
weaverbird_s_midedge_subdivision = WeaverbirdsMidedgeSubdivision(MeshCurves=mesh_surface, Level=1, SmoothNakedEdges=1)

dispatch = Dispatch(List=nakedvertices.NakedPts, DispatchPattern=[True, False])  # -> ListA, ListB
shift_list = ShiftList(List=dispatch.ListB, Shift=2, Wrap=True)
split_list = SplitList(List=shift_list, Index=30)  # -> ListA, ListB

end_points = EndPoints(Curve=weaverbird_s_midedge_subdivision)  # -> Start, End
weaverbird_s_picture_frame = WeaverbirdsPictureFrame(MeshPolylines=weaverbird_s_midedge_subdivision, Distance=25, InsetType=0)
create_set = CreateSet(List=[end_points.Start, end_points.End])  # -> Set, Map
interpolate_2 = Interpolate(Vertices=split_list.ListA, Degree=3, Periodic=True, KnotStyle=1)  # -> Curve, Length, Domain
scale = Scale(Geometry=interpolate_2.Curve, Center=Point(0, 0, 0), Factor=0.5)  # -> Geometry, Transform
scale_2 = Scale(Geometry=create_set.Set, Center=Point(0, 0, 0), Factor=0.5)  # -> Geometry, Transform
scale_3 = Scale(Geometry=weaverbird_s_midedge_subdivision, Center=Point(0, 0, 0), Factor=0.5)  # -> Geometry, Transform
rotate = Rotate(Geometry=scale.Geometry, Angle=number_slider, Plane=PlaneXY(0, 0, 0))  # -> Geometry, Transform
rotate_2 = Rotate(Geometry=scale_2.Geometry, Angle=number_slider, Plane=PlaneXY(0, 0, 0))  # -> Geometry, Transform
rotate_3 = Rotate(Geometry=scale_3.Geometry, Angle=number_slider, Plane=PlaneXY(0, 0, 0))  # -> Geometry, Transform
ruled_surface = RuledSurface(CurveA=interpolate_2.Curve, CurveB=rotate.Geometry)
mesh_surface_2 = MeshSurface(Surface=ruled_surface, UCount=number_slider_3, VCount=3, Overhang=True, Equalize=False)
weaverbird_s_picture_frame_2 = WeaverbirdsPictureFrame(MeshPolylines=rotate_3.Geometry, Distance=25, InsetType=0)
weaverbird_s_loop_subdivision = WeaverbirdsLoopSubdivision(MeshCurves=mesh_surface_2, Level=1, SmoothNakedEdges=1)
line_2 = Line(StartPoint=create_set.Set, EndPoint=rotate_2.Geometry)
weaverbird_s_midedge_subdivision_2 = WeaverbirdsMidedgeSubdivision(MeshCurves=weaverbird_s_loop_subdivision, Level=1, SmoothNakedEdges=1)
weaverbird_s_picture_frame_3 = WeaverbirdsPictureFrame(MeshPolylines=weaverbird_s_midedge_subdivision_2, Distance=30, InsetType=0)
weaverbird_s_mesh_thicken = WeaverbirdsMeshThicken(MeshCurves=weaverbird_s_picture_frame_2, Distance=2, OffsetType=0)
weaverbird_s_mesh_thicken_2 = WeaverbirdsMeshThicken(MeshCurves=weaverbird_s_picture_frame, Distance=2.5, OffsetType=0)
weaverbird_s_mesh_thicken_3 = WeaverbirdsMeshThicken(MeshCurves=weaverbird_s_picture_frame_3, Distance=3, OffsetType=0)
