# Grasshopper definition GrowingCirclePaking.gh (Grasshopper 1.0.5)
# plug-ins: Kangaroo Components

# Growing Circle Packing
surface = Surface([<surface referenced from the Rhino model> x2])
populate_geometry = PopulateGeometry(Geometry=surface, Count=Slider(100, range=0..100), Seed=Slider(20, range=0..100))  # -> flatten(Population)
number_slider = Slider(120, range=0..5000)
curve = Curve([<curve referenced from the Rhino model> x2])
subtraction = Subtraction(A=number_slider, B=1)
growingcirclepacking = PythonScript(boundary=curve, points=populate_geometry, time=number_slider)  # -> out, a; inputs boundary: list, BackUp: list, points: list, time: Int32
# ---------- growingcirclepacking: Python ----------
import rhinoscriptsyntax as rs
import Rhino
import scriptcontext


class Circle:

    def __init__(self,position,boundID):
        self.position = position
        self.radius =1
        self.boundID = boundID
        self.growing = True
    
    def display(self):
        circle = rs.AddCircle(self.position,self.radius)
        return circle
        
    def grow(self):
        if(self.growing):
            self.radius+=1
            
    def edges(self):
        count=0
        for i in range(len(self.boundID)):
            result = rs.CurveCurveIntersection(self.display(),self.boundID[i])
            if(result!=None):
                count+=1
        if(count==0):
            return False
        else:
            return True


#initialize every growing circle at point position

cList=[]
for i in range(len(points)):
    c=Circle(points[i],boundary)
    cList.append(c)
    


#grow circles by time
timeList=[]

for t in range(time):

    circleList=[]
    for c in cList:
        #check if circle can grow
        if(c.growing):
            if(c.edges()):
                c.growing = False
            else:
                for other in cList:
                    if(c!=other):
                        d = rs.Distance(c.position,other.position)
                        if(d-2<c.radius+other.radius):
                            c.growing = False
                            break

        c.grow()
        circle=c.display()
        circleList.append(circle)
    timeList.append(circleList)


a=timeList
# ---------- end growingcirclepacking ----------

# ----
# Counter Python
boolean_toggle = BooleanToggle(True)
timer = Timer(TimerInterval=500, Target=ghpython_script)
ghpython_script = GhPythonScript(start=boolean_toggle)  # -> out, a
# ---------- ghpython_script: Python ----------
__author__ = "GG"
__version__ = "2018.08.28"

import rhinoscriptsyntax as rs
import scriptcontext as sc

sc.sticky.has_key("timer")
if(start):
    a=sc.sticky["timer"]
    sc.sticky["timer"]=a+1
else:
    sc.sticky["timer"]=0
# ---------- end ghpython_script ----------
panel = Panel(ghpython_script.a)

# ----
# Counter C#
boolean_toggle_2 = BooleanToggle(True)
timer_2 = Timer(TimerInterval=500, Target=c_script)
c_script = CSharpScript(start=boolean_toggle_2)  # -> out, A; inputs start: Boolean
# ---------- c_script: C# ----------
    if(start){
      x += 1;
    }
      A = x;
# ---------- c_script: C# additional code ----------
int x=0;
# ---------- end c_script ----------
panel_2 = Panel(c_script.A)

# ----
# Counter Kangaroo2
boolean_toggle_3 = BooleanToggle(False)
timer_3 = Timer(TimerInterval=5, Target=counter)
counter = Counter(Reset=boolean_toggle_3)
panel_3 = Panel(counter)

unpackpylist = PythonScript(x=growingcirclepacking.a)  # -> out, simplify(a)
# ---------- unpackpylist: Python ----------
import collections

xIsList = isinstance(x,collections.Iterable)
#if x is a list unpak it, if x is not a list,make it as a list
if (xIsList):
    a=x
else:
    a=[x]
# ---------- end unpackpylist ----------

# ----
# Animation
tree_statistics = TreeStatistics(Tree=unpackpylist.a)  # -> Paths, Length, Count
list_item = ListItem(List=tree_statistics.Paths, Index=counter, Wrap=True)
tree_branch = TreeBranch(Tree=unpackpylist.a, Path=list_item, MaintainPaths=True)
custom_preview = CustomPreview(Geometry=tree_branch, Material=ColourSwatch(SwatchColor=RGB(255, 255, 255)))

# ----
# Static
list_item_2 = ListItem(List=tree_statistics.Paths, Index=subtraction, Wrap=True)
tree_branch_2 = TreeBranch(Tree=unpackpylist.a, Path=list_item_2, MaintainPaths=True)
custom_preview_2 = CustomPreview(Geometry=tree_branch_2, Material=ColourSwatch(SwatchColor=RGB(255, 255, 255)))
