# Grasshopper definition pattern.gh (Grasshopper 0.9.76)

sqgrid = Square(Plane=PlaneXY(0, 0, 0), Size="10", ExtentX="20", ExtentY="20")  # -> Cells, Points
srf = Surface(<surface referenced from the Rhino model>)
divide = DivideDomain²(Domain=srf, UCount="20", VCount="20")
cpoly = ControlPolygon(Curve=flatten(sqgrid.Cells))  # -> Polygon, Points
item = ListItem(List=cpoly.Points, Index=0, Wrap=True)  # -> Item, Item1, Item2, Item3
sbox = SurfaceBox(Surface=srf, Domain=divide, Height=1)  # -> graft(TwistedBox)
addition = Addition(A=item.Item1, B=item.Item3)
crv = Curve(flatten(sqgrid.Cells))
Z = UnitZ(Factor="0.5")
area = Area(Geometry=sqgrid.Cells)  # -> Area, graft(Centroid)
division = Division(A=addition, B=2)
move = Move(Geometry=division, Motion=Z)  # -> Geometry, Transform
graft = GraftTree(Tree=crv, IncludeEmptyLists=True, IncludeNullItems=True)
arc = Arc(Plane=item.Item, Radius=expr("x/2", "10"), Angle=Domain(0, 1.570796327))  # -> Arc, Length
arc_2 = Arc(Plane=item.Item2, Radius=expr("x/2", "10"), Angle=Domain(3.141592654, 4.71238898))  # -> Arc, Length
intcrv = Interpolate(Vertices=[item.Item1, move.Geometry, item.Item3], Degree=3, Periodic=False, KnotStyle=1)  # -> Curve, Length, Domain
crv_2 = Curve([arc.Arc, arc_2.Arc, intcrv.Curve, graft])
tstat = TreeStatistics(Tree=crv_2)  # -> Paths, Length, Count
random = Random(Range=Domain(0, 3), Number=tstat.Count, Seed=2)
int = Integer(random)
multiplication = Multiplication(A=int, B=1.570796327)  # -> graft(Result)
rotate = Rotate(Geometry=crv_2, Angle=multiplication, Plane=area.Centroid)  # -> simplify(Geometry), Transform
item_2 = ListItem(List=rotate.Geometry, Index=0, Wrap=True)  # -> Item, Item1, Item2, Item3
Z_2 = UnitZ(Factor=1)
move_2 = Move(Geometry=[item_2.Item, item_2.Item1], Motion=Z_2)  # -> Geometry, Transform
crv_3 = Curve([move_2.Geometry, item_2.Item2])
item_3 = ListItem(List=crv_3, Index=0, Wrap=True)  # -> Item, Item1, Item2
cpoly_2 = ControlPolygon(Curve=item_2.Item3)  # -> Polygon, Points
end = EndPoints(Curve=[item_3.Item, item_3.Item1])  # -> Start, End
item_4 = ListItem(List=cpoly_2.Points, Index=0, Wrap=True)  # -> Item, Item1, Item2, Item3
item_5 = ListItem(List=[end.Start, end.End], Index=0, Wrap=True)  # -> Item, Item1, Item2, Item3
darc = DeconstructArc(Arc=[item_3.Item, item_3.Item1])  # -> BasePlane, Radius, Angle
flip = FlipCurve(Curve=item_3.Item1)  # -> Curve, Flag
panel = Panel(crv_2)
move_3 = Move(Geometry=darc.BasePlane, Motion=expr("-x", Z_2))  # -> Geometry, Transform
loft = Loft(
    Curves=[item_3.Item, item_3.Item2],
    Options={Adjust=False, Closed=False, LoftEnds=0, LoftSimp=0, LoftType=0, Rebuild=10, Refit=0.01})
extr = ExtrudePoint(Base=[item_3.Item, item_3.Item1], Point=move_3.Geometry)
loft_2 = Loft(
    Curves=[flip.Curve, item_3.Item2],
    Options={Adjust=False, Closed=False, LoftEnds=0, LoftSimp=0, LoftType=0, Rebuild=10, Refit=0.01})

srf4pt = _4PointSurface(CornerA=item_4.Item2, CornerB=item_5.Item1, CornerC=item_4.Item3)  # -> simplify(Surface)
srf4pt_2 = _4PointSurface(CornerA=item_4.Item3, CornerB=item_5.Item2, CornerC=item_4.Item)  # -> simplify(Surface)
srf4pt_3 = _4PointSurface(CornerA=item_4.Item, CornerB=item_5.Item, CornerC=item_4.Item1)  # -> simplify(Surface)
srf4pt_4 = _4PointSurface(CornerA=item_4.Item1, CornerB=item_5.Item3, CornerC=item_4.Item2)  # -> simplify(Surface)

srf_2 = Surface([loft, loft_2, extr, srf4pt_3, srf4pt_4, srf4pt, srf4pt_2])
join = BrepJoin(Breps=srf_2)  # -> Breps, Closed
panel_2 = Panel(srf4pt_4)
bbox = BoundingBox(Content=join.Breps, Plane=PlaneXY(0, 0, 0))  # -> Box, Box_2
morph = BoxMorph(Geometry=join.Breps, Reference=bbox.Box, Target=sbox)
