# Grasshopper definition clouds.gh (Grasshopper 1.0.5)

point = Point([<point referenced from the Rhino model> x4])
point_2 = Point([<point referenced from the Rhino model> x7])
point_3 = Point([<point referenced from the Rhino model> x7])
point_4 = Point([<point referenced from the Rhino model> x4])
point_5 = Point([<point referenced from the Rhino model> x5])
point_6 = Point([<point referenced from the Rhino model> x3])
spin_force = SpinForce(Plane=point, Strength="5", Radius="5", Decay=1.2)
spin_force_2 = SpinForce(Plane=point_2, Strength="5", Radius="4", Decay=1.2)
spin_force_3 = SpinForce(Plane=point_3, Strength="5", Radius="3", Decay=1.2)
spin_force_4 = SpinForce(Plane=point_4, Strength="-1", Radius="3", Decay=0.15)  # disabled
spin_force_5 = SpinForce(Plane=point_5, Strength="3", Radius="2", Decay=1)
spin_force_6 = SpinForce(Plane=point_6, Strength="5", Radius="3", Decay=1)
point_charge = PointCharge(Point=point_4, Charge=-0.05, Decay=0.2)
point_charge_2 = PointCharge(Charge=5, Decay=1)  # disabled
surface = Surface(<surface referenced from the Rhino model>)
divide_surface = DivideSurface(Surface=surface, UCount="30", VCount="30")  # -> flatten(Points), Normals, Parameters
merge_fields = MergeFields(Fields=flatten([point_charge_2, spin_force, spin_force_2, spin_force_3, spin_force_4, point_charge, spin_force_5, spin_force_6]))
point_7 = Point([<point referenced from the Rhino model> x6])
field_line = FieldLine(Field=merge_fields, Point=point_7, Steps=500, Accuracy=1, Method=4)
rebuild_curve = RebuildCurve(Curve=field_line, Degree=3, Count=500, Tangents=False)
list_item = ListItem(List=rebuild_curve, Index=Slider(302, range=0..800), Wrap=True)
