# Grasshopper definition windows.gh (Grasshopper 1.0.5)
# plug-ins: Weaverbird

surface = Surface(<surface referenced from the Rhino model>)
dimensions = Dimensions(Surface=surface)  # -> UDimension, VDimension
plane_surface = PlaneSurface(Plane=PlaneXY(0, 0, 0), XSize=dimensions.UDimension, YSize=dimensions.VDimension)
populate_geometry = PopulateGeometry(Geometry=plane_surface, Count=Slider(200, range=100..900), Seed=Slider(108, range=1..120))
curve = Curve(plane_surface)
voronoi = Voronoi(Points=populate_geometry, Boundary=curve, BruteForceOverride=False)
area = Area(Geometry=voronoi)  # -> Area, Centroid
scale = Scale(Geometry=voronoi, Center=area.Centroid, Factor=Slider(0.92, range=0..1))  # -> Geometry, Transform
unit_z = UnitZ(Factor=expr("x*-1", Slider(0.1, range=0.05..0.3)))
curve_2 = Curve(flatten([curve, scale.Geometry]))
area_2 = Area(Geometry=voronoi)  # -> Area, Centroid
move = Move(Geometry=curve_2, Motion=unit_z)  # -> Geometry, Transform
scale_2 = Scale(Geometry=voronoi, Center=area_2.Centroid, Factor=Slider(0.97, range=0..1))  # -> Geometry, Transform
curve_3 = Curve(flatten([curve, scale_2.Geometry]))
curve_4 = Curve(flatten([curve, voronoi]))
graft_tree = GraftTree(Tree=move.Geometry, IncludeEmptyLists=True, IncludeNullItems=True)  # -> simplify(Tree)
graft_tree_2 = GraftTree(Tree=curve_3, IncludeEmptyLists=True, IncludeNullItems=True)  # -> simplify(Tree)
graft_tree_3 = GraftTree(Tree=curve_4, IncludeEmptyLists=True, IncludeNullItems=True)  # -> simplify(Tree)
merge = Merge(Data1=graft_tree, Data2=graft_tree_2)
merge_2 = Merge(Data1=graft_tree_3, Data2=graft_tree_2)
loft = Loft(Curves=merge, Options={Adjust=False, Closed=False, LoftEnds=0, LoftSimp=0, LoftType=0, Rebuild=10, Refit=0.01})  # -> simplify(Loft)
loft_2 = Loft(Curves=merge_2, Options={Adjust=False, Closed=False, LoftEnds=0, LoftSimp=0, LoftType=0, Rebuild=10, Refit=0.01})
brep_join = BrepJoin(Breps=flatten(loft))  # -> Breps, Closed
brep_join_2 = BrepJoin(Breps=flatten(loft_2))  # -> Breps, Closed
list_item = ListItem(List=brep_join_2.Breps, Index=1, Wrap=True)
simple_mesh = SimpleMesh(Brep=brep_join.Breps)
simple_mesh_2 = SimpleMesh(Brep=list_item)
merge_3 = Merge(Data1=simple_mesh, Data2=simple_mesh_2)  # -> flatten(Result)
weaverbird_s_catmull_clark_subdivision = WeaverbirdsCatmullClarkSubdivision(MeshCurves=merge_3, Level=3, SmoothNakedEdges=2)  # -> flatten(OutputMeshCurves)
split_list = SplitList(List=weaverbird_s_catmull_clark_subdivision, Index=1)  # -> ListA, ListB
plane = Plane(PlaneXY(0, 0, 0))
mirror = Mirror(Geometry=split_list.ListB, Plane=plane)  # -> Geometry, Transform
move_2 = Move(Geometry=mirror.Geometry, Motion=expr("x*2", unit_z))  # -> flatten(Geometry), Transform
mesh_join = MeshJoin(Meshes=[split_list.ListB, move_2.Geometry])  # -> flatten(Mesh)
mesh_join_2 = MeshJoin(Meshes=mesh_join)
number_slider = Slider(2.4, range=1..3)
division = Division(A=1, B=number_slider)
mesh = Mesh(mesh_join_2)
scale_nu = ScaleNU(Geometry=mesh, Plane=PlaneXY(0, 0, 0), ScaleX=1, ScaleY=number_slider, ScaleZ=1)  # -> Geometry, Transform
construct_domain = ConstructDomain(DomainStart=Slider(0, range=0..1), DomainEnd=Slider(1, range=0..1))
construct_domain_2 = ConstructDomain(DomainStart=Slider(0, range=0..1), DomainEnd=Slider(1, range=0..1))
construct_domain_3 = ConstructDomain(DomainStart=Slider(0, range=0..1), DomainEnd=Slider(0.07, range=0..1))
box = Box(mesh)
surface_morph = SurfaceMorph(
    Geometry=mesh,
    Reference=box,
    Surface=reparameterize(surface),
    UDomain=construct_domain_2,
    VDomain=construct_domain,
    WDomain=construct_domain_3)
mesh_2 = Mesh(surface_morph)
smooth_mesh = SmoothMesh(Mesh=mesh_2, Strength=0.5, SkipNaked=True, Iterations=1)
