# Grasshopper definition HeightLabel.gh (Grasshopper 1.0.5)
# plug-ins: Karamba, LunchBox, Bowerbird

道路中心线 = 道路中心线()
curve = Curve([<curve referenced from the Rhino model> x28])
unit_z = UnitZ(Factor=1000)
extrude = Extrude(Base=curve, Direction=unit_z)
deconstruct_brep = DeconstructBrep(Brep=extrude)  # -> Faces, Edges, Vertices
rebuild_surface = RebuildSurface(Surface=deconstruct_brep.Faces, UDegree=3, VDegree=1, UNumber=2, VNumber=300)  # -> flatten(RebuiltSurface)
地形网格 = 地形网格()
mesh = Mesh(<mesh referenced from the Rhino model>)
mesh_mesh = MeshMesh(MeshA=rebuild_surface, MeshB=mesh, UseMeshMeshFast=True)
道路地形投影线 = 道路地形投影线()
坡度检测间距 = 坡度检测间距()
curve_2 = Curve(mesh_mesh)
number_slider = Slider(30, range=1..30)
curve_3 = Curve(flatten(curve_2))
divide_length = DivideLength(Curve=curve_2, Length=30)  # -> flatten(Points), Tangents, Parameters
divide_curve = DivideCurve(Curve=curve_2, Count=1, Kinks=False)  # -> flatten(Points), Tangents, Parameters
merge = Merge(Data1=divide_curve.Points, Data2=divide_length.Points)
左边界点 = 左边界点()
道路选点去重 = 道路选点去重()
point = Point(Point(2425.36325, 9703.61, 43.53304882))
下边界点 = 下边界点()
remove_duplicate_points_karamba = RemoveDuplicatePointsKaramba(Point=merge, LimitDistance=19)  # -> OutPoint, Info, Indexes
point_2 = Point(Point(4131.960509, 8659.818049, 139.3096912))
deconstruct_vector = DeconstructVector(Vector=point_2)  # -> XComponent, YComponent, ZComponent
deconstruct_vector_2 = DeconstructVector(Vector=point)  # -> XComponent, YComponent, ZComponent
a_b原点 = AB原点()
deconstruct_vector_3 = DeconstructVector(Vector=remove_duplicate_points_karamba.OutPoint)  # -> XComponent, YComponent, ZComponent
construct_point = ConstructPoint(XCoordinate=deconstruct_vector_2.XComponent, YCoordinate=deconstruct_vector.YComponent, ZCoordinate=0)
number_slider_2 = Slider(2, range=0..5)
坡度限制 = 坡度限制()
number_slider_3 = Slider(4, range=1..6)

deconstruct_vector_4 = DeconstructVector(Vector=remove_duplicate_points_karamba.OutPoint)  # -> XComponent, YComponent, ZComponent
deconstruct_vector_5 = DeconstructVector(Vector=remove_duplicate_points_karamba.OutPoint)  # -> XComponent, YComponent, ZComponent
ghpython_script = GhPythonScript(x=deconstruct_vector_4.ZComponent, y=Slider(2, range=0..5))  # -> out, a; inputs x: list, y: Int32
# ---------- ghpython_script: Python ----------
__author__ = "Zhijun"
__version__ = "2019.04.25"

a=[]

for i in x:
    a.append(round(i,y))
# ---------- end ghpython_script ----------
number = Number(500)
vector_xyz = VectorXYZ(XComponent=deconstruct_vector_5.XComponent, YComponent=expr("x+7", deconstruct_vector_5.YComponent), ZComponent=number)  # -> Vector, Length
bb_text = BBText(
    Location=vector_xyz.Vector,
    Text=ghpython_script.a,
    Size=Slider(6, range=2..7),
    Bold=False,
    HorizontalAlignment=0,
    VerticalAlignment=2)

subtraction = Subtraction(A=deconstruct_vector_3.XComponent, B=deconstruct_vector_2.XComponent)
vector_xyz_2 = VectorXYZ(
    XComponent=expr("x+3.5", deconstruct_vector_5.XComponent),
    YComponent=expr("X-3", deconstruct_vector_5.YComponent),
    ZComponent=number)  # -> Vector, Length
ghpython_script_2 = GhPythonScript(x=subtraction, y=number_slider_2)  # -> out, a, b; inputs x: list, y: Int32
# ---------- ghpython_script_2: Python ----------
__author__ = "Zhijun"
__version__ = "2019.04.25"

a=[]
b=[]

for i in x:
    a.append(round(i,y))
    b.append("A:"+str(round(i,y)))
# ---------- end ghpython_script_2 ----------
bb_text_2 = BBText(
    Location=vector_xyz_2.Vector,
    Text=ghpython_script_2.b,
    Size=number_slider_3,
    Bold=False,
    HorizontalAlignment=1,
    VerticalAlignment=2)

subtraction_2 = Subtraction(A=deconstruct_vector_3.YComponent, B=deconstruct_vector.YComponent)
vector_xyz_3 = VectorXYZ(
    XComponent=expr("x+3.5", deconstruct_vector_5.XComponent),
    YComponent=expr("X-8", deconstruct_vector_5.YComponent),
    ZComponent=number)  # -> Vector, Length
ghpython_script_3 = GhPythonScript(x=subtraction_2, y=number_slider_2)  # -> out, a, b; inputs x: list, y: Int32
# ---------- ghpython_script_3: Python ----------
__author__ = "Zhijun"
__version__ = "2019.04.25"

a=[]
b=[]

for i in x:
    a.append(round(i,y))
    b.append("B:"+str(round(i,y)))
# ---------- end ghpython_script_3 ----------
bb_text_3 = BBText(
    Location=vector_xyz_3.Vector,
    Text=ghpython_script_3.b,
    Size=number_slider_3,
    Bold=False,
    HorizontalAlignment=1,
    VerticalAlignment=2)

vector_xyz_4 = VectorXYZ(XComponent=deconstruct_vector_5.XComponent, YComponent=deconstruct_vector_5.YComponent, ZComponent=number)  # -> Vector, Length
vector_2pt = Vector2Pt(PointA=Point(2314.98686, 8724.075318, 0), PointB=vector_xyz_4.Vector, Unitize=False)  # -> Vector, Length
curve_4 = Curve(<curve referenced from the Rhino model>)
move = Move(Geometry=curve_4, Motion=vector_2pt.Vector)  # -> Geometry, Transform

高度文字输出 = 高度文字输出()
b坐标文字输出 = B坐标文字输出()
a坐标文字输出 = A坐标文字输出()
标注图案输出 = 标注图案输出()
坡度超标点 = 坡度超标点()
surface = Surface(<surface referenced from the Rhino model>)
create_material = CreateMaterial(Diffuse=RGB(0, 0, 0), Specular=RGB(255, 255, 255), Emission=RGB(0, 0, 0), Transparency=0, Shine=0)
move_2 = Move(Geometry=surface, Motion=vector_2pt.Vector)  # -> Geometry, Transform
标注填充输出 = 标注填充输出()
custom_preview = CustomPreview(Geometry=move_2.Geometry, Material=create_material)

divide_length_2 = DivideLength(Curve=curve_3, Length=number_slider)  # -> Points, Tangents, Parameters
list_length = ListLength(List=divide_length_2.Points)  # -> expr("X-1", Length)
shift_list = ShiftList(List=divide_length_2.Points, Shift=2, Wrap=True)
split_list = SplitList(List=divide_length_2.Points, Index=list_length)  # -> ListA, ListB
deconstruct = Deconstruct(Point=shift_list)  # -> XComponent, YComponent, ZComponent
split_list_2 = SplitList(List=split_list.ListA, Index=1)  # -> ListA, ListB
deconstruct_2 = Deconstruct(Point=divide_length_2.Points)  # -> XComponent, YComponent, ZComponent
deconstruct_3 = Deconstruct(Point=split_list_2.ListB)  # -> XComponent, YComponent, ZComponent
subtraction_3 = Subtraction(A=deconstruct_2.ZComponent, B=deconstruct.ZComponent)
list_length_2 = ListLength(List=deconstruct_2.ZComponent)  # -> expr("X-2", Length)
absolute = Absolute(Value=subtraction_3)
split_list_3 = SplitList(List=absolute, Index=list_length_2)  # -> ListA, ListB
number_2 = Number(split_list_3.ListA)

multiplication = Multiplication(A=Slider(0.15, range=0..0.2), B=number_slider)

larger_than = LargerThan(FirstNumber=number_2, SecondNumber=expr("x*2", multiplication))  # -> LargerThan, OrEqualTo
cull_pattern = CullPattern(List=divide_length_2.Points, CullPattern=larger_than.OrEqualTo)
