# Grasshopper definition Slice.gh (Grasshopper 1.0.5)

number_slider = Slider(2, range=1..10)
mesh = Mesh([<mesh referenced from the Rhino model> x2])
mesh_join = MeshJoin(Meshes=mesh)
unit_z = UnitZ(Factor=number_slider)
contour = Contour(Shape=mesh_join, Point=Point(0, 0, 0), Direction=Vector(0, 0, 1), Distance=number_slider)
boundary_surfaces = BoundarySurfaces(Edges=contour)  # disabled
extrude = Extrude(Base=boundary_surfaces, Direction=unit_z)
