# Grasshopper definition 1216.gh (Grasshopper 1.0.5)
# plug-ins: Pufferfish

curve = Curve([<curve referenced from the Rhino model> x2])
curve_2 = Curve([<curve referenced from the Rhino model> x2])
curve_3 = Curve([<curve referenced from the Rhino model> x2])
curve_4 = Curve([<curve referenced from the Rhino model> x2])
curve_5 = Curve([<curve referenced from the Rhino model> x2])
curve_6 = Curve([<curve referenced from the Rhino model> x2])
curve_7 = Curve([<curve referenced from the Rhino model> x2])
curve_8 = Curve([<curve referenced from the Rhino model> x2])
curve_9 = Curve([<curve referenced from the Rhino model> x2])
curve_10 = Curve([<curve referenced from the Rhino model> x2])
curve_11 = Curve([<curve referenced from the Rhino model> x2])
curve_12 = Curve([<curve referenced from the Rhino model> x2])
curve_13 = Curve([<curve referenced from the Rhino model> x2])
curve_14 = Curve([<curve referenced from the Rhino model> x2])
curve_15 = Curve([<curve referenced from the Rhino model> x2])
curve_16 = Curve([<curve referenced from the Rhino model> x2])
curve_17 = Curve([<curve referenced from the Rhino model> x2])
curve_18 = Curve([<curve referenced from the Rhino model> x2])
curve_19 = Curve([<curve referenced from the Rhino model> x2])
curve_20 = Curve([<curve referenced from the Rhino model> x2])
curve_21 = Curve([<curve referenced from the Rhino model> x2])
curve_22 = Curve([<curve referenced from the Rhino model> x2])
curve_23 = Curve([<curve referenced from the Rhino model> x2])
curve_24 = Curve([<curve referenced from the Rhino model> x2])  # disabled
curve_25 = Curve([<curve referenced from the Rhino model> x2])
层数 = 层数()
curve_26 = Curve([<curve referenced from the Rhino model> x2])
curve_27 = Curve([<curve referenced from the Rhino model> x2])
curve_28 = Curve([<curve referenced from the Rhino model> x2])
curve_29 = Curve([<curve referenced from the Rhino model> x2])
curve_30 = Curve([<curve referenced from the Rhino model> x2])
curve_31 = Curve([<curve referenced from the Rhino model> x2])
curve_32 = Curve([<curve referenced from the Rhino model> x2])
curve_33 = Curve([<curve referenced from the Rhino model> x2])
curve_34 = Curve([<curve referenced from the Rhino model> x2])
curve_35 = Curve([<curve referenced from the Rhino model> x2])
curve_36 = Curve([<curve referenced from the Rhino model> x2])
curve_37 = Curve()
curve_38 = Curve([<curve referenced from the Rhino model> x2])
curve_39 = Curve([<curve referenced from the Rhino model> x2])
curve_40 = Curve([<curve referenced from the Rhino model> x2])
curve_41 = Curve([<curve referenced from the Rhino model> x2])
curve_42 = Curve([<curve referenced from the Rhino model> x2])
curve_43 = Curve([<curve referenced from the Rhino model> x2])
curve_44 = Curve([<curve referenced from the Rhino model> x2])
curve_45 = Curve([<curve referenced from the Rhino model> x2])
curve_46 = Curve([<curve referenced from the Rhino model> x2])
curve_47 = Curve([<curve referenced from the Rhino model> x2])
curve_48 = Curve([<curve referenced from the Rhino model> x2])
curve_49 = Curve([<curve referenced from the Rhino model> x2])
curve_50 = Curve()  # disabled
curve_51 = Curve([<curve referenced from the Rhino model> x2])  # disabled
curve_52 = Curve()  # disabled
curve_53 = Curve([<curve referenced from the Rhino model> x2])  # disabled
curve_54 = Curve([<curve referenced from the Rhino model> x2])  # disabled
curve_55 = Curve()  # disabled
curve_56 = Curve()  # disabled
curve_57 = Curve([<curve referenced from the Rhino model> x2])  # disabled
curve_58 = Curve([<curve referenced from the Rhino model> x2])  # disabled
entwine = Entwine(
    Branch00=curve_10,
    Branch01=curve_6,
    Branch02=curve_7,
    Branch03=curve_14,
    Branch04=curve_11,
    Branch05=curve_12,
    Branch06=curve_15,
    Branch07=curve_16,
    Branch08=curve_5,
    Branch09=curve_13,
    Branch010=curve_8,
    Branch011=curve_9,
    Branch012=curve_22,
    Branch013=curve_23,
    Branch014=curve_24,
    Branch015=curve_17,
    Branch016=curve_18,
    Branch017=curve_25,
    Branch018=curve_19,
    Branch019=curve_20,
    Branch020=curve_21,
    Branch021=curve,
    Branch022=curve_2,
    Branch023=curve_3,
    Branch024=curve_4,
    FlattenInputs=True)  # -> simplify(Result)
curve_59 = Curve([<curve referenced from the Rhino model> x2])  # disabled
curve_60 = Curve([<curve referenced from the Rhino model> x2])
curve_61 = Curve([<curve referenced from the Rhino model> x2])  # disabled
curve_62 = Curve([<curve referenced from the Rhino model> x2])  # disabled
curve_63 = Curve([<curve referenced from the Rhino model> x2])  # disabled
curve_64 = Curve([<curve referenced from the Rhino model> x2])  # disabled
curve_65 = Curve([<curve referenced from the Rhino model> x2])
curve_66 = Curve([<curve referenced from the Rhino model> x2])
curve_67 = Curve([<curve referenced from the Rhino model> x2])
curve_68 = Curve([<curve referenced from the Rhino model> x2])
curve_69 = Curve([<curve referenced from the Rhino model> x2])
层数_2 = 层数()
层数_3 = 层数()
entwine_2 = Entwine(
    Branch00=curve_49,
    Branch01=curve_47,
    Branch02=curve_48,
    Branch03=curve_46,
    Branch04=curve_45,
    Branch05=curve_42,
    Branch06=curve_43,
    Branch07=curve_39,
    Branch08=curve_44,
    Branch09=curve_40,
    Branch010=curve_41,
    Branch011=curve_38,
    Branch012=curve_36,
    Branch013=curve_32,
    Branch014=curve_33,
    Branch015=curve_29,
    Branch016=curve_34,
    Branch017=curve_27,
    Branch018=curve_30,
    Branch019=curve_28,
    Branch020=curve_26,
    Branch021=curve_35,
    Branch022=curve_31,
    Branch023=curve_37,
    FlattenInputs=True)
entwine_3 = Entwine(
    Branch00=curve_69,
    Branch01=curve_67,
    Branch02=curve_68,
    Branch03=curve_66,
    Branch04=curve_65,
    Branch05=curve_60,
    Branch06=curve_61,
    Branch07=curve_59,
    Branch08=curve_64,
    Branch09=curve_62,
    Branch010=curve_63,
    Branch011=curve_58,
    Branch012=curve_57,
    Branch013=curve_53,
    Branch014=curve_54,
    Branch015=curve_51,
    Branch016=curve_55,
    Branch017=curve_52,
    Branch018=curve_56,
    Branch019=curve_50,
    FlattenInputs=True)
clean_tree = CleanTree(RemoveNulls=True, RemoveInvalid=True, RemoveEmpty=True, Tree=entwine)
multiplication = Multiplication(A=Slider(1, range=1..3), B=3.6)
clean_tree_2 = CleanTree(RemoveNulls=True, RemoveInvalid=True, RemoveEmpty=True, Tree=entwine_2)
unit_z = UnitZ(Factor=multiplication)
join_curves = JoinCurves(Curves=clean_tree, Preserve=False)
multiplication_2 = Multiplication(A=Slider(2, range=1..3), B=3.6)
clean_tree_3 = CleanTree(RemoveNulls=True, RemoveInvalid=True, RemoveEmpty=True, Tree=entwine_3)
multiplication_3 = Multiplication(A=Slider(3, range=1..3), B=3.6)
unit_z_2 = UnitZ(Factor=multiplication_2)
join_curves_2 = JoinCurves(Curves=clean_tree_2, Preserve=False)
unit_z_3 = UnitZ(Factor=multiplication_3)
move = Move(Geometry=join_curves, Motion=unit_z)  # -> Geometry, Transform
join_curves_3 = JoinCurves(Curves=clean_tree_3, Preserve=False)
move_2 = Move(Geometry=join_curves_2, Motion=unit_z_2)  # -> Geometry, Transform
move_3 = Move(Geometry=join_curves_3, Motion=unit_z_3)  # -> Geometry, Transform
dispatch = Dispatch(List=move.Geometry, DispatchPattern=[True, False])  # -> ListA, ListB
dispatch_2 = Dispatch(List=move_2.Geometry, DispatchPattern=[True, False])  # -> ListA, ListB
dispatch_3 = Dispatch(List=move_3.Geometry, DispatchPattern=[True, False])  # -> ListA, ListB

flip_curve = FlipCurve(Curve=dispatch.ListA, Guide=dispatch.ListB)  # -> Curve, Flag
坡度控制参数 = 层数()
end_points = EndPoints(Curve=flip_curve.Curve)  # -> Start, End
end_points_2 = EndPoints(Curve=dispatch.ListB)  # -> Start, End
tween_two_curves = TweenTwoCurves(CurveA=flip_curve.Curve, CurveB=dispatch.ListB, Factor=0.5, Refit=False, SamplePoint=0)
distance = Distance(PointA=end_points.Start, PointB=end_points_2.Start)
multiplication_4 = Multiplication(A=distance, B=Slider(0.2, range=0.1..1.1))
unit_z_4 = UnitZ(Factor=multiplication_4)
move_4 = Move(Geometry=tween_two_curves, Motion=unit_z_4)  # -> Geometry, Transform

dispatch_4 = Dispatch(List=join_curves, DispatchPattern=[True, False])  # -> ListA, ListB
flip_curve_2 = FlipCurve(Curve=dispatch_4.ListA, Guide=dispatch_4.ListB)  # -> Curve, Flag
merge = Merge(Data1=flip_curve.Curve, Data2=move_4.Geometry, Data3=dispatch.ListB, Data4=dispatch_4.ListB, Data5=flip_curve_2.Curve)
loft_options = LoftOptions(Closed=True, Adjust=False, Rebuild=0, Refit=0, Type=3)
loft = Loft(Curves=merge, Options=loft_options)
brep_edges = BrepEdges(Brep=loft)  # -> Naked, Interior, NonManifold
boundary_surfaces = BoundarySurfaces(Edges=brep_edges.Naked)
brep = Brep(loft)
offset_surface = OffsetSurface(Surface=boundary_surfaces, Distance=Slider(0.25, range=0.1..0.3), BothSides=True, CreateSolid=True)
cap_holes_ex = CapHolesEx(Brep=brep)  # -> Brep, Caps, Solid

flip_curve_3 = FlipCurve(Curve=dispatch_2.ListA, Guide=dispatch_2.ListB)  # -> Curve, Flag
坡度控制参数_2 = 层数()
end_points_3 = EndPoints(Curve=flip_curve_3.Curve)  # -> Start, End
end_points_4 = EndPoints(Curve=dispatch_2.ListB)  # -> Start, End
tween_two_curves_2 = TweenTwoCurves(CurveA=flip_curve_3.Curve, CurveB=dispatch_2.ListB, Factor=0.5, Refit=False, SamplePoint=0)
distance_2 = Distance(PointA=end_points_3.Start, PointB=end_points_4.Start)
multiplication_5 = Multiplication(A=distance_2, B=Slider(0.2, range=0.1..1.1))
unit_z_5 = UnitZ(Factor=multiplication_5)
move_5 = Move(Geometry=tween_two_curves_2, Motion=unit_z_5)  # -> Geometry, Transform

dispatch_5 = Dispatch(List=join_curves_2, DispatchPattern=[True, False])  # -> ListA, ListB
flip_curve_4 = FlipCurve(Curve=dispatch_5.ListA, Guide=dispatch_5.ListB)  # -> Curve, Flag
merge_2 = Merge(
    Data1=flip_curve_3.Curve,
    Data2=move_5.Geometry,
    Data3=dispatch_2.ListB,
    Data4=dispatch_5.ListB,
    Data5=flip_curve_4.Curve)
loft_options_2 = LoftOptions(Closed=True, Adjust=False, Rebuild=0, Refit=0, Type=3)
loft_2 = Loft(Curves=merge_2, Options=loft_options_2)
brep_edges_2 = BrepEdges(Brep=loft_2)  # -> Naked, Interior, NonManifold
boundary_surfaces_2 = BoundarySurfaces(Edges=brep_edges_2.Naked)
brep_2 = Brep(loft_2)
offset_surface_2 = OffsetSurface(Surface=boundary_surfaces_2, Distance=Slider(0.25, range=0.1..0.3), BothSides=True, CreateSolid=True)
cap_holes_ex_2 = CapHolesEx(Brep=brep_2)  # -> Brep, Caps, Solid

flip_curve_5 = FlipCurve(Curve=dispatch_3.ListA, Guide=dispatch_3.ListB)  # -> Curve, Flag
坡度控制参数_3 = 层数()
end_points_5 = EndPoints(Curve=flip_curve_5.Curve)  # -> Start, End
end_points_6 = EndPoints(Curve=dispatch_3.ListB)  # -> Start, End
tween_two_curves_3 = TweenTwoCurves(CurveA=flip_curve_5.Curve, CurveB=dispatch_3.ListB, Factor=0.5, Refit=False, SamplePoint=0)
distance_3 = Distance(PointA=end_points_5.Start, PointB=end_points_6.Start)
multiplication_6 = Multiplication(A=distance_3, B=Slider(0.2, range=0.1..1.1))
unit_z_6 = UnitZ(Factor=multiplication_6)
move_6 = Move(Geometry=tween_two_curves_3, Motion=unit_z_6)  # -> Geometry, Transform

dispatch_6 = Dispatch(List=join_curves_3, DispatchPattern=[True, False])  # -> ListA, ListB
flip_curve_6 = FlipCurve(Curve=dispatch_6.ListA, Guide=dispatch_6.ListB)  # -> Curve, Flag
merge_3 = Merge(
    Data1=flip_curve_5.Curve,
    Data2=move_6.Geometry,
    Data3=dispatch_3.ListB,
    Data4=dispatch_6.ListB,
    Data5=flip_curve_6.Curve)
loft_options_3 = LoftOptions(Closed=True, Adjust=False, Rebuild=0, Refit=0, Type=3)
loft_3 = Loft(Curves=merge_3, Options=loft_options_3)
brep_edges_3 = BrepEdges(Brep=loft_3)  # -> Naked, Interior, NonManifold
boundary_surfaces_3 = BoundarySurfaces(Edges=brep_edges_3.Naked)
brep_3 = Brep(loft_3)
offset_surface_3 = OffsetSurface(Surface=boundary_surfaces_3, Distance=Slider(0.25, range=0.1..0.3), BothSides=True, CreateSolid=True)
cap_holes_ex_3 = CapHolesEx(Brep=brep_3)  # -> Brep, Caps, Solid

explode = Explode(Curve=clean_tree, Recursive=True)  # -> Segments, Vertices

point_divide_curve_target_length = PointDivideCurveTargetLength(Curve=clean_tree_2, Target=4, DivisionType=2, EndPoint=True)  # -> Points, Tangents, Parameters, Length
柱半径参数 = 层数()
move_7 = Move(Geometry=point_divide_curve_target_length.Points, Motion=unit_z_2)  # -> Geometry, Transform
line = Line(StartPoint=move_7.Geometry, EndPoint=point_divide_curve_target_length.Points)
pipe = Pipe(Curve=line, Radius=Slider(0.15, range=0.1..0.3), Caps=1)

point_divide_curve_target_length_2 = PointDivideCurveTargetLength(Curve=clean_tree_3, Target=4, DivisionType=2, EndPoint=True)  # -> Points, Tangents, Parameters, Length
柱半径参数_2 = 层数()
move_8 = Move(Geometry=point_divide_curve_target_length_2.Points, Motion=unit_z_3)  # -> Geometry, Transform
line_2 = Line(StartPoint=move_8.Geometry, EndPoint=point_divide_curve_target_length_2.Points)
pipe_2 = Pipe(Curve=line_2, Radius=Slider(0.15, range=0.1..0.3), Caps=1)

圈梁下移参数 = 层数()
unit_z_7 = UnitZ(Factor=graft([Slider(-0.4, range=-2..-0.1), Slider(-0.7, range=-2..-0.5)]))
move_9 = Move(Geometry=join_curves_2, Motion=unit_z_2)  # -> Geometry, Transform
move_10 = Move(Geometry=move_9.Geometry, Motion=graft(unit_z_7))  # -> Geometry, Transform
圈梁半径参数 = 层数()
pipe_3 = Pipe(Curve=move_10.Geometry, Radius=Slider(0.1, range=0.01..0.5), Caps=1)

contour = Contour(Shape=flatten(boundary_surfaces), Point=Point(0, 0, 0), Direction=Vector(0, 0, 1), Distance=4)  # -> flatten(Contours)
窗户高度 = 层数()
dispatch_7 = Dispatch(List=contour, DispatchPattern=[True, False])  # -> ListA, ListB
point_divide_curve_target_length_3 = PointDivideCurveTargetLength(Curve=dispatch_7.ListA, Target=0.6, DivisionType=0, EndPoint=True)  # -> Points, Tangents, Parameters, Length
unit_z_8 = UnitZ(Factor=Slider(1.2, range=0.1..1.5))
list_length = ListLength(List=point_divide_curve_target_length_3.Points)
list_item = ListItem(List=point_divide_curve_target_length_3.Points, Index=expr("x/2", list_length), Wrap=True)  # -> Item1, Item
entwine_4 = Entwine(Branch00=list_item.Item1, Branch01=list_item.Item, FlattenInputs=True)
flip_matrix = FlipMatrix(Data=entwine_4)
move_11 = Move(Geometry=flip_matrix, Motion=unit_z_8)  # -> Geometry, Transform
unit_z_9 = UnitZ(Factor=2)
move_12 = Move(Geometry=move_11.Geometry, Motion=unit_z_9)  # -> Geometry, Transform
dispatch_8 = Dispatch(List=move_11.Geometry, DispatchPattern=[True, False])  # -> ListA, ListB
dispatch_9 = Dispatch(List=move_12.Geometry, DispatchPattern=[True, False])  # -> ListA, ListB
_4point_surface = _4PointSurface(CornerA=dispatch_8.ListA, CornerB=dispatch_8.ListB, CornerC=dispatch_9.ListB, CornerD=dispatch_9.ListA)
offset_surface_4 = OffsetSurface(Surface=_4point_surface, Distance=1, BothSides=True, CreateSolid=True)
plane_origin = PlaneOrigin(Base=PlaneXY(0, 0, 0), Origin=Point(132624.0919, 149454.0188, 0))
plane_3pt = Plane3Pt(PointA=dispatch_8.ListA, PointB=dispatch_8.ListB, PointC=dispatch_9.ListA)
orient = Orient(Source=plane_origin, Target=plane_3pt)  # -> Geometry, Transform
mesh = Mesh(<mesh referenced from the Rhino model>)
transform = Transform(Geometry=mesh, Transform=orient.Transform)

point_divide_curve_target_length_4 = PointDivideCurveTargetLength(Curve=explode.Segments, Target=4, DivisionType=2, EndPoint=True)  # -> Points, Tangents, Parameters, Length
柱半径参数_3 = 层数()
move_13 = Move(Geometry=point_divide_curve_target_length_4.Points, Motion=unit_z)  # -> Geometry, Transform
line_3 = Line(StartPoint=move_13.Geometry, EndPoint=point_divide_curve_target_length_4.Points)
pipe_4 = Pipe(Curve=line_3, Radius=Slider(0.15, range=0.1..0.3), Caps=1)

圈梁下移参数_2 = 层数()
unit_z_10 = UnitZ(Factor=graft([Slider(-0.4, range=-2..-0.1), Slider(-0.7, range=-2..-0.5)]))
move_14 = Move(Geometry=join_curves_3, Motion=unit_z_3)  # -> Geometry, Transform
move_15 = Move(Geometry=move_14.Geometry, Motion=graft(unit_z_10))  # -> Geometry, Transform
圈梁半径参数_2 = 层数()
pipe_5 = Pipe(Curve=move_15.Geometry, Radius=Slider(0.1, range=0.01..0.5), Caps=1)

contour_2 = Contour(Shape=flatten(boundary_surfaces_3), Point=Point(0, 0, 0), Direction=Vector(0, 0, 1), Distance=4)  # -> flatten(Contours)
dispatch_10 = Dispatch(List=contour_2, DispatchPattern=[True, True, True, False])  # -> ListA, ListB
窗户高度_2 = 层数()
point_divide_curve_target_length_5 = PointDivideCurveTargetLength(Curve=dispatch_10.ListA, Target=1, DivisionType=0, EndPoint=True)  # -> Points, Tangents, Parameters, Length
list_length_2 = ListLength(List=point_divide_curve_target_length_5.Points)
unit_z_11 = UnitZ(Factor=Slider(0.8, range=0.1..1.5))
list_item_2 = ListItem(List=point_divide_curve_target_length_5.Points, Index=expr("x/2", list_length_2), Wrap=True)  # -> Item1, Item
entwine_5 = Entwine(Branch00=list_item_2.Item1, Branch01=list_item_2.Item, FlattenInputs=True)
unit_z_12 = UnitZ(Factor=2.1)
flip_matrix_2 = FlipMatrix(Data=entwine_5)
move_16 = Move(Geometry=flip_matrix_2, Motion=unit_z_11)  # -> Geometry, Transform
move_17 = Move(Geometry=move_16.Geometry, Motion=unit_z_12)  # -> Geometry, Transform
dispatch_11 = Dispatch(List=move_16.Geometry, DispatchPattern=[True, False])  # -> ListA, ListB
dispatch_12 = Dispatch(List=move_17.Geometry, DispatchPattern=[True, False])  # -> ListA, ListB
_4point_surface_2 = _4PointSurface(CornerA=dispatch_11.ListA, CornerB=dispatch_11.ListB, CornerC=dispatch_12.ListB, CornerD=dispatch_12.ListA)
offset_surface_5 = OffsetSurface(Surface=_4point_surface_2, Distance=1, BothSides=True, CreateSolid=True)
plane_origin_2 = PlaneOrigin(Base=PlaneXY(0, 0, 0), Origin=Point(132624.0919, 149454.0188, 0))
plane_3pt_2 = Plane3Pt(PointA=dispatch_11.ListA, PointB=dispatch_11.ListB, PointC=dispatch_12.ListA)
orient_2 = Orient(Source=plane_origin_2, Target=plane_3pt_2)  # -> Geometry, Transform
mesh_2 = Mesh(<mesh referenced from the Rhino model>)
transform_2 = Transform(Geometry=mesh_2, Transform=orient_2.Transform)

立面墙高度 = 层数()
立面墙宽度 = 层数()
unit_z_13 = UnitZ(Factor=Slider(3.4, range=3..4))
move_18 = Move(Geometry=join_curves_2, Motion=unit_z_13)  # -> Geometry, Transform
unit_z_14 = UnitZ(Factor=Slider(0.7, range=0.1..1.5))
move_19 = Move(Geometry=move_18.Geometry, Motion=unit_z_14)  # -> Geometry, Transform
ruled_surface = RuledSurface(CurveA=move_18.Geometry, CurveB=move_19.Geometry)
立面墙厚度 = 层数()
offset_surface_6 = OffsetSurface(Surface=ruled_surface, Distance=Slider(0.17, range=0.1..0.5), BothSides=True, CreateSolid=True)

圈梁下移参数_3 = 层数()
unit_z_15 = UnitZ(Factor=graft([Slider(-0.4, range=-2..-0.1), Slider(-0.5, range=-2..-0.5)]))
move_20 = Move(Geometry=join_curves, Motion=unit_z)  # -> Geometry, Transform
move_21 = Move(Geometry=move_20.Geometry, Motion=graft(unit_z_15))  # -> Geometry, Transform
圈梁半径参数_3 = 层数()
pipe_6 = Pipe(Curve=move_21.Geometry, Radius=Slider(0.1, range=0.01..0.5), Caps=1)

merge_4 = Merge(Data1=flip_curve.Curve, Data2=move_4.Geometry, Data3=dispatch.ListB)
merge_5 = Merge(Data1=flip_curve_3.Curve, Data2=move_5.Geometry, Data3=dispatch_2.ListB)
侧墙厚度 = 层数()
merge_6 = Merge(Data1=flip_curve_5.Curve, Data2=move_6.Geometry, Data3=dispatch_3.ListB)
loft_options_4 = LoftOptions(Closed=False, Adjust=False, Rebuild=0, Refit=0, Type=3)
侧墙厚度_2 = 层数()
loft_options_5 = LoftOptions(Closed=False, Adjust=False, Rebuild=0, Refit=0, Type=3)
侧墙厚度_3 = 层数()
loft_options_6 = LoftOptions(Closed=False, Adjust=False, Rebuild=0, Refit=0, Type=3)

surface_points = SurfacePoints(Surface=boundary_surfaces)  # -> Points, Weights, Greville, UCount, VCount
list_item_3 = ListItem(List=surface_points.Points, Index=0, Wrap=True)  # -> Item, Item1, Item2, Item3
surface_from_points = SurfaceFromPoints(Points=surface_points.Points, UCount=surface_points.UCount, Interpolate=False)
plane_3pt_3 = Plane3Pt(PointA=list_item_3.Item, PointB=list_item_3.Item1, PointC=list_item_3.Item2)
scale = Scale(Geometry=surface_from_points, Center=plane_3pt_3, Factor=1.2)  # -> Geometry, Transform
surface_points_2 = SurfacePoints(Surface=scale.Geometry)  # -> Points, Weights, Greville, UCount, VCount
surface_from_points_2 = SurfaceFromPoints(Points=surface_points_2.Points, UCount=surface_points_2.UCount, Interpolate=False)
list_item_4 = ListItem(List=surface_points_2.Points, Index=0, Wrap=True)  # -> Item, Item1, Item2, Item3
plane_3pt_4 = Plane3Pt(PointA=list_item_4.Item3, PointB=list_item_4.Item1, PointC=list_item_4.Item2)
scale_2 = Scale(Geometry=surface_from_points_2, Center=plane_3pt_4, Factor=1.1)  # -> Geometry, Transform

surface_points_3 = SurfacePoints(Surface=boundary_surfaces_2)  # -> Points, Weights, Greville, UCount, VCount
list_item_5 = ListItem(List=surface_points_3.Points, Index=0, Wrap=True)  # -> Item, Item1, Item2, Item3
surface_from_points_3 = SurfaceFromPoints(Points=surface_points_3.Points, UCount=surface_points_3.UCount, Interpolate=False)
plane_3pt_5 = Plane3Pt(PointA=list_item_5.Item, PointB=list_item_5.Item1, PointC=list_item_5.Item2)
scale_3 = Scale(Geometry=surface_from_points_3, Center=plane_3pt_5, Factor=1.2)  # -> Geometry, Transform
surface_points_4 = SurfacePoints(Surface=scale_3.Geometry)  # -> Points, Weights, Greville, UCount, VCount
surface_from_points_4 = SurfaceFromPoints(Points=surface_points_4.Points, UCount=surface_points_4.UCount, Interpolate=False)
list_item_6 = ListItem(List=surface_points_4.Points, Index=0, Wrap=True)  # -> Item, Item1, Item2, Item3
plane_3pt_6 = Plane3Pt(PointA=list_item_6.Item3, PointB=list_item_6.Item1, PointC=list_item_6.Item2)
scale_4 = Scale(Geometry=surface_from_points_4, Center=plane_3pt_6, Factor=1.1)  # -> Geometry, Transform

divide_curve = DivideCurve(Curve=move_4.Geometry, Count=2, Kinks=False)  # -> Points, Tangents, Parameters

surface_points_5 = SurfacePoints(Surface=boundary_surfaces_3)  # -> Points, Weights, Greville, UCount, VCount
list_item_7 = ListItem(List=surface_points_5.Points, Index=0, Wrap=True)  # -> Item, Item1, Item2, Item3
surface_from_points_5 = SurfaceFromPoints(Points=surface_points_5.Points, UCount=surface_points_5.UCount, Interpolate=False)
plane_3pt_7 = Plane3Pt(PointA=list_item_7.Item, PointB=list_item_7.Item1, PointC=list_item_7.Item2)
scale_5 = Scale(Geometry=surface_from_points_5, Center=plane_3pt_7, Factor=1.2)  # -> Geometry, Transform
surface_points_6 = SurfacePoints(Surface=scale_5.Geometry)  # -> Points, Weights, Greville, UCount, VCount
surface_from_points_6 = SurfaceFromPoints(Points=surface_points_6.Points, UCount=surface_points_6.UCount, Interpolate=False)
list_item_8 = ListItem(List=surface_points_6.Points, Index=0, Wrap=True)  # -> Item, Item1, Item2, Item3
plane_3pt_8 = Plane3Pt(PointA=list_item_8.Item3, PointB=list_item_8.Item1, PointC=list_item_8.Item2)
scale_6 = Scale(Geometry=surface_from_points_6, Center=plane_3pt_8, Factor=1.1)  # -> Geometry, Transform

divide_curve_2 = DivideCurve(Curve=move_5.Geometry, Count=2, Kinks=False)  # -> Points, Tangents, Parameters
divide_curve_3 = DivideCurve(Curve=move_6.Geometry, Count=2, Kinks=False)  # -> Points, Tangents, Parameters
list_item_9 = ListItem(List=divide_curve.Points, Index=1, Wrap=True)
list_item_10 = ListItem(List=divide_curve_2.Points, Index=1, Wrap=True)
list_item_11 = ListItem(List=divide_curve_3.Points, Index=1, Wrap=True)
solid_difference = SolidDifference(BrepsA=offset_surface, BrepsB=offset_surface_4)
surface = Surface(<surface referenced from the Rhino model>)
solid_difference_2 = SolidDifference(BrepsA=offset_surface_3, BrepsB=flatten(offset_surface_5))
屋顶大小参数 = 层数()
屋顶大小参数_2 = 层数()
number_slider = Slider(1.08, range=1..1.5)
屋顶大小参数_3 = 层数()
number_slider_2 = Slider(1.07, range=1..1.5)
number_slider_3 = Slider(1.05, range=1..1.5)
colour_picker = ColourPicker(PickedColour=RGB(255, 255, 255))  # disabled
colour_picker_2 = ColourPicker(PickedColour=RGB(41, 29, 29))
colour_picker_3 = ColourPicker(PickedColour=RGB(214, 186, 186))
colour_picker_4 = ColourPicker(PickedColour=RGB(56, 48, 48))
colour_picker_5 = ColourPicker(PickedColour=RGB(171, 154, 154))
colour_picker_6 = ColourPicker(PickedColour=RGB(237, 140, 140))
colour_picker_7 = ColourPicker(PickedColour=RGB(181, 164, 150))
colour_picker_8 = ColourPicker(PickedColour=RGB(110, 109, 109))
colour_picker_9 = ColourPicker(PickedColour=RGB(61, 60, 60))
colour_picker_10 = ColourPicker(PickedColour=RGB(224, 220, 220))
colour_picker_11 = ColourPicker(PickedColour=RGB(133, 118, 101))
colour_picker_12 = ColourPicker(PickedColour=RGB(41, 27, 27))
colour_picker_13 = ColourPicker(PickedColour=RGB(41, 10, 10))
create_material = CreateMaterial(Diffuse=colour_picker, Specular=RGB(255, 255, 255), Emission=RGB(0, 0, 0), Transparency=0, Shine=0)  # disabled
create_material_2 = CreateMaterial(Diffuse=colour_picker_2, Specular=RGB(255, 255, 255), Emission=RGB(0, 0, 0), Transparency=0, Shine=0)
create_material_3 = CreateMaterial(Diffuse=colour_picker_3, Specular=RGB(255, 255, 255), Emission=RGB(0, 0, 0), Transparency=0, Shine=0)
create_material_4 = CreateMaterial(Diffuse=colour_picker_5, Specular=RGB(255, 255, 255), Emission=RGB(0, 0, 0), Transparency=0, Shine=0)
create_material_5 = CreateMaterial(Diffuse=colour_picker_7, Specular=RGB(255, 255, 255), Emission=RGB(0, 0, 0), Transparency=0, Shine=0)
create_material_6 = CreateMaterial(Diffuse=colour_picker_9, Specular=RGB(255, 255, 255), Emission=RGB(0, 0, 0), Transparency=0, Shine=0)
create_material_7 = CreateMaterial(Diffuse=colour_picker_10, Specular=RGB(255, 255, 255), Emission=RGB(0, 0, 0), Transparency=0, Shine=0)
create_material_8 = CreateMaterial(Diffuse=colour_picker_4, Specular=RGB(255, 255, 255), Emission=RGB(0, 0, 0), Transparency=0, Shine=0)
create_material_9 = CreateMaterial(Diffuse=colour_picker_6, Specular=RGB(255, 255, 255), Emission=RGB(0, 0, 0), Transparency=0, Shine=0)
create_material_10 = CreateMaterial(Diffuse=colour_picker_8, Specular=RGB(255, 255, 255), Emission=RGB(0, 0, 0), Transparency=0, Shine=0)
create_material_11 = CreateMaterial(Diffuse=colour_picker_11, Specular=RGB(255, 255, 255), Emission=RGB(0, 0, 0), Transparency=0, Shine=0)
create_material_12 = CreateMaterial(Diffuse=colour_picker_12, Specular=RGB(255, 255, 255), Emission=RGB(0, 0, 0), Transparency=0, Shine=0)
create_material_13 = CreateMaterial(Diffuse=colour_picker_13, Specular=RGB(255, 255, 255), Emission=RGB(0, 0, 0), Transparency=0, Shine=0)
custom_preview = CustomPreview(Geometry=[cap_holes_ex.Brep, cap_holes_ex_2.Brep, cap_holes_ex_3.Brep], Material=create_material)  # disabled
custom_preview_2 = CustomPreview(Geometry=[pipe_6, pipe_3, pipe_5], Material=create_material_5)
custom_preview_3 = CustomPreview(Geometry=[pipe_4, pipe, pipe_2], Material=create_material_11)
层数_4 = 层数()
层数_5 = 层数()
屋顶梁 = 层数()
侧墙窗户 = 层数()
层数_6 = 层数()
层数_7 = 层数()
层数_8 = 层数()
层数_9 = 层数()
层数_10 = 层数()
立面墙 = 层数()
层数_11 = 层数()
层数_12 = 层数()

split_list = SplitList(List=point_divide_curve_target_length.Points, Index=1)  # -> ListA, ListB
extrude = Extrude(Base=join_curves_2, Direction=unit_z_2)
list_length_3 = ListLength(List=split_list.ListB)
split_list_2 = SplitList(List=split_list.ListB, Index=expr("x-1", list_length_3))  # -> ListA, ListB
point = Point(split_list_2.ListA)
polyline = PolyLine(Vertices=point, Closed=False)
explode_2 = Explode(Curve=polyline, Recursive=True)  # -> Segments, Vertices
divide_curve_4 = DivideCurve(Curve=explode_2.Segments, Count=2, Kinks=False)  # -> Points, Tangents, Parameters
list_item_12 = ListItem(List=divide_curve_4.Points, Index=1, Wrap=True)
list_item_13 = ListItem(List=divide_curve_4.Points, Index=2, Wrap=True)
offset_surface_7 = OffsetSurface(Surface=extrude, Distance=0.05, BothSides=True, CreateSolid=True)
move_22 = Move(Geometry=list_item_12, Motion=Vector(0, 0, 10))  # -> Geometry, Transform
plane_3pt_9 = Plane3Pt(PointA=list_item_12, PointB=list_item_13, PointC=move_22.Geometry)
plane_origin_3 = PlaneOrigin(Base=PlaneXY(0, 0, 0), Origin=Point(132626.8667, 149453.4534, 0))
surface_2 = Surface(<surface referenced from the Rhino model>)
orient_3 = Orient(Source=plane_origin_3, Target=plane_3pt_9)  # -> Geometry, Transform
mesh_3 = Mesh(<mesh referenced from the Rhino model>)
transform_3 = Transform(Geometry=surface_2, Transform=orient_3.Transform)
offset_surface_8 = OffsetSurface(Surface=transform_3, Distance=1, BothSides=True, CreateSolid=True)
transform_4 = Transform(Geometry=mesh_3, Transform=orient_3.Transform)

split_list_3 = SplitList(List=point_divide_curve_target_length_2.Points, Index=1)  # -> ListA, ListB
extrude_2 = Extrude(Base=join_curves_3, Direction=unit_z_3)
list_length_4 = ListLength(List=split_list_3.ListB)
split_list_4 = SplitList(List=split_list_3.ListB, Index=expr("x-1", list_length_4))  # -> ListA, ListB
point_2 = Point(split_list_4.ListA)
polyline_2 = PolyLine(Vertices=point_2, Closed=False)
explode_3 = Explode(Curve=polyline_2, Recursive=True)  # -> Segments, Vertices
divide_curve_5 = DivideCurve(Curve=explode_3.Segments, Count=2, Kinks=False)  # -> Points, Tangents, Parameters
list_item_14 = ListItem(List=divide_curve_5.Points, Index=1, Wrap=True)
list_item_15 = ListItem(List=divide_curve_5.Points, Index=2, Wrap=True)
offset_surface_9 = OffsetSurface(Surface=extrude_2, Distance=0.05, BothSides=True, CreateSolid=True)
move_23 = Move(Geometry=list_item_14, Motion=Vector(0, 0, 10))  # -> Geometry, Transform
plane_3pt_10 = Plane3Pt(PointA=list_item_14, PointB=list_item_15, PointC=move_23.Geometry)
plane_origin_4 = PlaneOrigin(Base=PlaneXY(0, 0, 0), Origin=Point(132626.8667, 149453.4534, 0))
surface_3 = Surface(<surface referenced from the Rhino model>)
orient_4 = Orient(Source=plane_origin_4, Target=plane_3pt_10)  # -> Geometry, Transform
mesh_4 = Mesh(<mesh referenced from the Rhino model>)
transform_5 = Transform(Geometry=surface_3, Transform=orient_4.Transform)
offset_surface_10 = OffsetSurface(Surface=transform_5, Distance=1, BothSides=True, CreateSolid=True)
transform_6 = Transform(Geometry=mesh_4, Transform=orient_4.Transform)

split_list_5 = SplitList(List=point_divide_curve_target_length_4.Points, Index=1)  # -> ListA, ListB
extrude_3 = Extrude(Base=join_curves, Direction=unit_z)
list_length_5 = ListLength(List=split_list_5.ListB)
split_list_6 = SplitList(List=split_list_5.ListB, Index=expr("x-1", list_length_5))  # -> ListA, ListB
point_3 = Point(split_list_6.ListA)
polyline_3 = PolyLine(Vertices=point_3, Closed=False)
offset_surface_11 = OffsetSurface(Surface=extrude_3, Distance=0.05, BothSides=True, CreateSolid=True)
plane_origin_5 = PlaneOrigin(Base=PlaneXY(0, 0, 0), Origin=Point(132626.8667, 149453.4534, 0))
surface_4 = Surface(<surface referenced from the Rhino model>)
mesh_5 = Mesh(<mesh referenced from the Rhino model>)

下缘高度 = 层数()
shift_list = ShiftList(List=point_divide_curve_target_length.Points, Shift=1, Wrap=True)
line_4 = Line(StartPoint=point_divide_curve_target_length.Points, EndPoint=shift_list)
unit_z_16 = UnitZ(Factor=Slider(0.8, range=0.1..1))
下缘厚度 = 层数()
list_length_6 = ListLength(List=line_4)
split_list_7 = SplitList(List=line_4, Index=expr("x-1", list_length_6))  # -> ListA, ListB
extrude_4 = Extrude(Base=split_list_7.ListB, Direction=unit_z_16)
divide_curve_6 = DivideCurve(Curve=split_list_7.ListA, Count=2, Kinks=False)  # -> Points, Tangents, Parameters
list_item_16 = ListItem(List=divide_curve_6.Points, Index=1, Wrap=True)  # -> Item, Item1
move_24 = Move(Geometry=list_item_16.Item, Motion=Vector(0, 0, 10))  # -> Geometry, Transform
surface_5 = Surface(<surface referenced from the Rhino model>)
plane_3pt_11 = Plane3Pt(PointA=list_item_16.Item, PointB=list_item_16.Item1, PointC=move_24.Geometry)
orient_5 = Orient(Source=plane_origin_5, Target=plane_3pt_11)  # -> Geometry, Transform
transform_7 = Transform(Geometry=surface_5, Transform=orient_5.Transform)
offset_surface_12 = OffsetSurface(Surface=transform_7, Distance=1, BothSides=True, CreateSolid=True)
offset_surface_13 = OffsetSurface(Surface=extrude_4, Distance=Slider(0.12, range=0.01..0.3), BothSides=True, CreateSolid=True)
mesh_6 = Mesh(<mesh referenced from the Rhino model>)
transform_8 = Transform(Geometry=mesh_6, Transform=orient_5.Transform)
solid_difference_3 = SolidDifference(BrepsA=flatten(offset_surface_13), BrepsB=flatten(offset_surface_12))

下缘高度_2 = 层数()
shift_list_2 = ShiftList(List=point_divide_curve_target_length_2.Points, Shift=1, Wrap=True)
line_5 = Line(StartPoint=point_divide_curve_target_length_2.Points, EndPoint=shift_list_2)
下缘厚度_2 = 层数()
unit_z_17 = UnitZ(Factor=Slider(0.8, range=0.1..1))
list_length_7 = ListLength(List=line_5)
split_list_8 = SplitList(List=line_5, Index=expr("x-1", list_length_7))  # -> ListA, ListB
extrude_5 = Extrude(Base=split_list_8.ListB, Direction=unit_z_17)
divide_curve_7 = DivideCurve(Curve=split_list_8.ListA, Count=2, Kinks=False)  # -> Points, Tangents, Parameters
list_item_17 = ListItem(List=divide_curve_7.Points, Index=1, Wrap=True)  # -> Item, Item1
move_25 = Move(Geometry=list_item_17.Item, Motion=Vector(0, 0, 10))  # -> Geometry, Transform
surface_6 = Surface(<surface referenced from the Rhino model>)
plane_3pt_12 = Plane3Pt(PointA=list_item_17.Item, PointB=list_item_17.Item1, PointC=move_25.Geometry)
orient_6 = Orient(Source=plane_origin_5, Target=plane_3pt_12)  # -> Geometry, Transform
transform_9 = Transform(Geometry=surface_6, Transform=orient_6.Transform)
offset_surface_14 = OffsetSurface(Surface=transform_9, Distance=1, BothSides=True, CreateSolid=True)
offset_surface_15 = OffsetSurface(Surface=extrude_5, Distance=Slider(0.12, range=0.01..0.3), BothSides=True, CreateSolid=True)
mesh_7 = Mesh(<mesh referenced from the Rhino model>)
transform_10 = Transform(Geometry=mesh_7, Transform=orient_6.Transform)
solid_difference_4 = SolidDifference(BrepsA=flatten(offset_surface_15), BrepsB=flatten(offset_surface_14))

下缘高度_3 = 层数()
shift_list_3 = ShiftList(List=point_divide_curve_target_length_4.Points, Shift=1, Wrap=True)
line_6 = Line(StartPoint=point_divide_curve_target_length_4.Points, EndPoint=shift_list_3)
unit_z_18 = UnitZ(Factor=Slider(0.8, range=0.1..1))
下缘厚度_3 = 层数()
list_length_8 = ListLength(List=line_6)
split_list_9 = SplitList(List=line_6, Index=expr("x-1", list_length_8))  # -> ListA, ListB
extrude_6 = Extrude(Base=split_list_9.ListB, Direction=unit_z_18)
divide_curve_8 = DivideCurve(Curve=split_list_9.ListA, Count=2, Kinks=False)  # -> Points, Tangents, Parameters
list_item_18 = ListItem(List=divide_curve_8.Points, Index=1, Wrap=True)  # -> Item, Item1
move_26 = Move(Geometry=list_item_18.Item, Motion=Vector(0, 0, 10))  # -> Geometry, Transform
surface_7 = Surface(<surface referenced from the Rhino model>)
plane_3pt_13 = Plane3Pt(PointA=list_item_18.Item, PointB=list_item_18.Item1, PointC=move_26.Geometry)
orient_7 = Orient(Source=plane_origin_5, Target=plane_3pt_13)  # -> Geometry, Transform
transform_11 = Transform(Geometry=surface_7, Transform=orient_7.Transform)
offset_surface_16 = OffsetSurface(Surface=transform_11, Distance=1, BothSides=True, CreateSolid=True)
offset_surface_17 = OffsetSurface(Surface=extrude_6, Distance=Slider(0.12, range=0.01..0.3), BothSides=True, CreateSolid=True)
mesh_8 = Mesh(<mesh referenced from the Rhino model>)
transform_12 = Transform(Geometry=mesh_8, Transform=orient_7.Transform)
solid_difference_5 = SolidDifference(BrepsA=flatten(offset_surface_17), BrepsB=flatten(offset_surface_16))

shift_list_4 = ShiftList(List=point_3, Shift=1, Wrap=True)
line_7 = Line(StartPoint=point_3, EndPoint=shift_list_4)
clean_tree_4 = CleanTree(RemoveNulls=True, RemoveInvalid=True, RemoveEmpty=True, Tree=polyline_3)
trim_curve_with_points = TrimCurveWithPoints(Curve=polyline_3, Points=point_3)

窗户高度_3 = 层数()
move_27 = Move(Geometry=list_item_16.Item, Motion=Vector(0, 0, 10))  # -> Geometry, Transform
unit_z_19 = UnitZ(Factor=Slider(4.6, range=0.1..7))
plane_3pt_14 = Plane3Pt(PointA=list_item_16.Item, PointB=list_item_16.Item1, PointC=move_27.Geometry)
move_28 = Move(Geometry=plane_3pt_14, Motion=unit_z_19)  # -> Geometry, Transform
plane_origin_6 = PlaneOrigin(Base=PlaneXY(0, 0, 0), Origin=Point(132619.9734, 149458.768, 0))
orient_8 = Orient(Source=plane_origin_6, Target=move_28.Geometry)  # -> Geometry, Transform
surface_8 = Surface(<surface referenced from the Rhino model>)
transform_13 = Transform(Geometry=surface_8, Transform=orient_8.Transform)
mesh_9 = Mesh(<mesh referenced from the Rhino model>)
offset_surface_18 = OffsetSurface(Surface=transform_13, Distance=1, BothSides=True, CreateSolid=True)
transform_14 = Transform(Geometry=mesh_9, Transform=orient_8.Transform)

explode_4 = Explode(Curve=clean_tree_4, Recursive=False)  # -> Segments, Vertices
divide_curve_9 = DivideCurve(Curve=trim_curve_with_points, Count=2, Kinks=False)  # -> Points, Tangents, Parameters
list_item_19 = ListItem(List=divide_curve_9.Points, Index=1, Wrap=True)
list_item_20 = ListItem(List=divide_curve_9.Points, Index=2, Wrap=True)
move_29 = Move(Geometry=list_item_19, Motion=Vector(0, 0, 10))  # -> Geometry, Transform
plane_3pt_15 = Plane3Pt(PointA=list_item_19, PointB=list_item_20, PointC=move_29.Geometry)
orient_9 = Orient(Source=plane_origin_5, Target=plane_3pt_15)  # -> Geometry, Transform
transform_15 = Transform(Geometry=surface_4, Transform=orient_9.Transform)
offset_surface_19 = OffsetSurface(Surface=transform_15, Distance=1, BothSides=True, CreateSolid=True)
transform_16 = Transform(Geometry=mesh_5, Transform=orient_9.Transform)
solid_difference_6 = SolidDifference(BrepsA=flatten(offset_surface_11), BrepsB=flatten(offset_surface_16))

solid_difference_7 = SolidDifference(BrepsA=flatten(offset_surface_7), BrepsB=flatten([offset_surface_8, offset_surface_12, offset_surface_18]))

custom_preview_4 = CustomPreview(Geometry=[solid_difference_5, solid_difference_3, solid_difference_4], Material=create_material_6)
custom_preview_5 = CustomPreview(Geometry=[transform_12, transform_8, transform_10], Material=create_material_12)

contour_3 = Contour(Shape=flatten(boundary_surfaces_2), Point=Point(0, 0, 0), Direction=Vector(0, 0, 1), Distance=4)  # -> flatten(Contours)
dispatch_13 = Dispatch(List=contour_3, DispatchPattern=[True, False, False])  # -> ListA, ListB
窗户高度_4 = 层数()
unit_z_20 = UnitZ(Factor=Slider(0.8, range=0.1..1.5))
unit_z_21 = UnitZ(Factor=2)
plane_origin_7 = PlaneOrigin(Base=PlaneXY(0, 0, 0), Origin=Point(132624.0919, 149454.0188, 0))
mesh_10 = Mesh(<mesh referenced from the Rhino model>)

dispatch_14 = Dispatch(List=dispatch_13.ListB, DispatchPattern=[True, False])  # -> ListA, ListB

point_divide_curve_target_length_6 = PointDivideCurveTargetLength(Curve=[dispatch_13.ListA, dispatch_14.ListA], Target=0.8, DivisionType=0, EndPoint=True)  # -> Points, Tangents, Parameters, Length
list_length_9 = ListLength(List=point_divide_curve_target_length_6.Points)
list_item_21 = ListItem(List=point_divide_curve_target_length_6.Points, Index=expr("x/2", list_length_9), Wrap=True)  # -> Item1, Item
entwine_6 = Entwine(Branch00=list_item_21.Item1, Branch01=list_item_21.Item, FlattenInputs=True)
flip_matrix_3 = FlipMatrix(Data=entwine_6)
move_30 = Move(Geometry=flip_matrix_3, Motion=unit_z_20)  # -> Geometry, Transform
move_31 = Move(Geometry=move_30.Geometry, Motion=unit_z_21)  # -> Geometry, Transform
dispatch_15 = Dispatch(List=move_30.Geometry, DispatchPattern=[True, False])  # -> ListA, ListB
dispatch_16 = Dispatch(List=move_31.Geometry, DispatchPattern=[True, False])  # -> ListA, ListB
_4point_surface_3 = _4PointSurface(CornerA=dispatch_15.ListA, CornerB=dispatch_15.ListB, CornerC=dispatch_16.ListB, CornerD=dispatch_16.ListA)
offset_surface_20 = OffsetSurface(Surface=_4point_surface_3, Distance=1, BothSides=True, CreateSolid=True)
plane_3pt_16 = Plane3Pt(PointA=dispatch_15.ListA, PointB=dispatch_15.ListB, PointC=dispatch_16.ListA)
orient_10 = Orient(Source=plane_origin_7, Target=plane_3pt_16)  # -> Geometry, Transform
transform_17 = Transform(Geometry=mesh_10, Transform=orient_10.Transform)

solid_difference_8 = SolidDifference(BrepsA=offset_surface_2, BrepsB=flatten(offset_surface_20))
custom_preview_6 = CustomPreview(Geometry=[solid_difference, solid_difference_8, solid_difference_2], Material=create_material_3)
custom_preview_7 = CustomPreview(Geometry=[transform, transform_17, transform_2], Material=create_material_9)

立面墙高度_2 = 层数()
number_slider_4 = Slider(3.4, range=3..4)
立面墙宽度_2 = 层数()
unit_z_22 = UnitZ(Factor=Slider(0.7, range=0.1..1.5))
立面墙厚度_2 = 层数()

addition = Addition(A=3.6, B=number_slider_4)

unit_z_23 = UnitZ(Factor=[number_slider_4, addition])  # -> graft(UnitVector)
move_32 = Move(Geometry=flatten(join_curves_3), Motion=unit_z_23)  # -> Geometry, Transform
move_33 = Move(Geometry=move_32.Geometry, Motion=unit_z_22)  # -> Geometry, Transform
ruled_surface_2 = RuledSurface(CurveA=move_32.Geometry, CurveB=move_33.Geometry)
offset_surface_21 = OffsetSurface(Surface=ruled_surface_2, Distance=Slider(0.17, range=0.1..0.5), BothSides=True, CreateSolid=True)

custom_preview_8 = CustomPreview(Geometry=[offset_surface_6, offset_surface_21], Material=create_material_10)

shift_list_5 = ShiftList(List=point_divide_curve_target_length.Points, Shift=1, Wrap=True)
plane_3pt_17 = Plane3Pt(PointA=point_divide_curve_target_length.Points, PointB=shift_list_5, PointC=move_7.Geometry)
deconstruct_plane = DeconstructPlane(Plane=plane_3pt_17)  # -> Origin, XAxis, YAxis, ZAxis
rotate_3d = Rotate3D(Geometry=plane_3pt_17, Angle=1.570796327, Center=point_divide_curve_target_length.Points, Axis=deconstruct_plane.XAxis)  # -> Geometry, Transform
ellipse = Ellipse(Plane=rotate_3d.Geometry, Radius1=0.3, Radius2=0.1)  # -> Ellipse, Focus1, Focus2

control_points = ControlPoints(Curve=ellipse.Ellipse)  # -> Points, Weights, Knots
polyline_4 = PolyLine(Vertices=control_points.Points, Closed=True)

extrude_7 = Extrude(Base=polyline_4, Direction=unit_z_2)

shift_list_6 = ShiftList(List=point_divide_curve_target_length_2.Points, Shift=1, Wrap=True)
plane_3pt_18 = Plane3Pt(PointA=point_divide_curve_target_length_2.Points, PointB=shift_list_6, PointC=move_8.Geometry)
deconstruct_plane_2 = DeconstructPlane(Plane=plane_3pt_18)  # -> Origin, XAxis, YAxis, ZAxis
rotate_3d_2 = Rotate3D(
    Geometry=plane_3pt_18,
    Angle=1.570796327,
    Center=point_divide_curve_target_length_2.Points,
    Axis=deconstruct_plane_2.XAxis)  # -> Geometry, Transform
ellipse_2 = Ellipse(Plane=rotate_3d_2.Geometry, Radius1=0.3, Radius2=0.1)  # -> Ellipse, Focus1, Focus2

control_points_2 = ControlPoints(Curve=ellipse_2.Ellipse)  # -> Points, Weights, Knots
polyline_5 = PolyLine(Vertices=control_points_2.Points, Closed=True)

extrude_8 = Extrude(Base=polyline_5, Direction=unit_z_3)

shift_list_7 = ShiftList(List=point_divide_curve_target_length_4.Points, Shift=1, Wrap=True)
plane_3pt_19 = Plane3Pt(PointA=point_divide_curve_target_length_4.Points, PointB=shift_list_7, PointC=move_13.Geometry)
deconstruct_plane_3 = DeconstructPlane(Plane=plane_3pt_19)  # -> Origin, XAxis, YAxis, ZAxis
rotate_3d_3 = Rotate3D(
    Geometry=plane_3pt_19,
    Angle=1.570796327,
    Center=point_divide_curve_target_length_4.Points,
    Axis=deconstruct_plane_3.XAxis)  # -> Geometry, Transform
ellipse_3 = Ellipse(Plane=rotate_3d_3.Geometry, Radius1=0.3, Radius2=0.08)  # -> Ellipse, Focus1, Focus2

control_points_3 = ControlPoints(Curve=ellipse_3.Ellipse)  # -> Points, Weights, Knots
polyline_6 = PolyLine(Vertices=control_points_3.Points, Closed=True)

extrude_9 = Extrude(Base=polyline_6, Direction=unit_z)

custom_preview_9 = CustomPreview(Geometry=[extrude_9, extrude_8, extrude_7], Material=create_material_4)

窗户高度_5 = 层数()
number_slider_5 = Slider(4.6, range=0.1..7)
move_34 = Move(Geometry=list_item_17.Item, Motion=Vector(0, 0, 10))  # -> Geometry, Transform
plane_3pt_20 = Plane3Pt(PointA=list_item_17.Item, PointB=list_item_17.Item1, PointC=move_34.Geometry)
plane_origin_8 = PlaneOrigin(Base=PlaneXY(0, 0, 0), Origin=Point(132619.9734, 149458.768, 0))
surface_9 = Surface(<surface referenced from the Rhino model>)
mesh_11 = Mesh(<mesh referenced from the Rhino model>)

addition_2 = Addition(A=number_slider_5, B=3.6)

unit_z_24 = UnitZ(Factor=[number_slider_5, addition_2])
move_35 = Move(Geometry=plane_3pt_20, Motion=unit_z_24)  # -> Geometry, Transform
orient_11 = Orient(Source=plane_origin_8, Target=move_35.Geometry)  # -> Geometry, Transform
transform_18 = Transform(Geometry=surface_9, Transform=orient_11.Transform)
offset_surface_22 = OffsetSurface(Surface=transform_18, Distance=1, BothSides=True, CreateSolid=True)
transform_19 = Transform(Geometry=mesh_11, Transform=orient_11.Transform)

solid_difference_9 = SolidDifference(BrepsA=flatten(offset_surface_9), BrepsB=flatten([offset_surface_10, offset_surface_14, offset_surface_22]))

custom_preview_10 = CustomPreview(Geometry=[solid_difference_7, solid_difference_6, solid_difference_9], Material=create_material_7)
custom_preview_11 = CustomPreview(Geometry=[transform_14, transform_16, transform_19], Material=create_material_13)

loft_4 = Loft(Curves=merge_4, Options=loft_options_4)
屋顶大小参数_4 = 层数()
number_slider_6 = Slider(1.2, range=1..1.2)
scale_7 = Scale(Geometry=loft_4, Center=list_item_9, Factor=number_slider_6)  # -> Geometry, Transform
屋顶厚度 = 层数()

split_brep_multiple = SplitBrepMultiple(Brep=scale_7.Geometry, Cutters=flatten(scale_2.Geometry))
area = Area(Geometry=split_brep_multiple)  # -> Area, Centroid
sort_list = SortList(Keys=area.Area, ValuesValuesA=split_brep_multiple)  # -> Keys, ValuesValuesA
reverse_list = ReverseList(List=sort_list.ValuesValuesA)
list_item_22 = ListItem(List=reverse_list, Index=0, Wrap=True)
scale_8 = Scale(Geometry=list_item_22, Center=list_item_9, Factor=number_slider)  # -> Geometry, Transform

offset_surface_23 = OffsetSurface(Surface=scale_8.Geometry, Distance=Slider(0.15, range=0.1..1.1), BothSides=True, CreateSolid=True)

屋顶梁大小参数 = 层数()
scale_9 = Scale(Geometry=move_4.Geometry, Center=list_item_9, Factor=number_slider_6)  # -> Geometry, Transform
unit_z_25 = UnitZ(Factor=expr("x*1", Slider(0.5, range=0.1..1.1)))
move_36 = Move(Geometry=scale_9.Geometry, Motion=unit_z_25)  # -> Geometry, Transform
ruled_surface_3 = RuledSurface(CurveA=scale_9.Geometry, CurveB=move_36.Geometry)

split_brep_multiple_2 = SplitBrepMultiple(Brep=ruled_surface_3, Cutters=flatten(scale_2.Geometry))
area_2 = Area(Geometry=split_brep_multiple_2)  # -> Area, Centroid
sort_list_2 = SortList(Keys=area_2.Area, ValuesValuesA=split_brep_multiple_2)  # -> Keys, ValuesValuesA
list_item_23 = ListItem(List=sort_list_2.ValuesValuesA, Index=2, Wrap=True)
scale_10 = Scale(Geometry=list_item_23, Center=list_item_9, Factor=number_slider)  # -> Geometry, Transform

offset_surface_24 = OffsetSurface(Surface=scale_10.Geometry, Distance=0.2, BothSides=True, CreateSolid=True)

loft_5 = Loft(Curves=merge_5, Options=loft_options_5)
屋顶大小参数_5 = 层数()
number_slider_7 = Slider(1.2, range=1..1.2)
scale_11 = Scale(Geometry=loft_5, Center=list_item_10, Factor=number_slider_7)  # -> Geometry, Transform
屋顶厚度_2 = 层数()

split_brep_multiple_3 = SplitBrepMultiple(Brep=scale_11.Geometry, Cutters=flatten(scale_4.Geometry))
area_3 = Area(Geometry=split_brep_multiple_3)  # -> Area, Centroid
sort_list_3 = SortList(Keys=area_3.Area, ValuesValuesA=split_brep_multiple_3)  # -> Keys, ValuesValuesA
reverse_list_2 = ReverseList(List=sort_list_3.ValuesValuesA)
list_item_24 = ListItem(List=reverse_list_2, Index=0, Wrap=True)
scale_12 = Scale(Geometry=list_item_24, Center=list_item_10, Factor=number_slider_2)  # -> Geometry, Transform

offset_surface_25 = OffsetSurface(Surface=scale_12.Geometry, Distance=Slider(0.15, range=0.1..1.1), BothSides=True, CreateSolid=True)

屋顶梁大小参数_2 = 层数()
scale_13 = Scale(Geometry=move_5.Geometry, Center=list_item_10, Factor=number_slider_7)  # -> Geometry, Transform
unit_z_26 = UnitZ(Factor=expr("x*1", Slider(0.5, range=0.1..1.1)))
move_37 = Move(Geometry=scale_13.Geometry, Motion=unit_z_26)  # -> Geometry, Transform
ruled_surface_4 = RuledSurface(CurveA=scale_13.Geometry, CurveB=move_37.Geometry)

split_brep_multiple_4 = SplitBrepMultiple(Brep=ruled_surface_4, Cutters=flatten(scale_4.Geometry))
area_4 = Area(Geometry=split_brep_multiple_4)  # -> Area, Centroid
sort_list_4 = SortList(Keys=area_4.Area, ValuesValuesA=split_brep_multiple_4)  # -> Keys, ValuesValuesA
list_item_25 = ListItem(List=sort_list_4.ValuesValuesA, Index=2, Wrap=True)
scale_14 = Scale(Geometry=list_item_25, Center=list_item_10, Factor=number_slider_2)  # -> Geometry, Transform

offset_surface_26 = OffsetSurface(Surface=scale_14.Geometry, Distance=0.2, BothSides=True, CreateSolid=True)

loft_6 = Loft(Curves=merge_6, Options=loft_options_6)
屋顶大小参数_6 = 层数()
number_slider_8 = Slider(1.2, range=1..1.2)
scale_15 = Scale(Geometry=loft_6, Center=list_item_11, Factor=number_slider_8)  # -> Geometry, Transform
屋顶厚度_3 = 层数()

split_brep_multiple_5 = SplitBrepMultiple(Brep=scale_15.Geometry, Cutters=flatten(scale_6.Geometry))
area_5 = Area(Geometry=split_brep_multiple_5)  # -> Area, Centroid
sort_list_5 = SortList(Keys=area_5.Area, ValuesValuesA=split_brep_multiple_5)  # -> Keys, ValuesValuesA
reverse_list_3 = ReverseList(List=sort_list_5.ValuesValuesA)
list_item_26 = ListItem(List=reverse_list_3, Index=0, Wrap=True)
scale_16 = Scale(Geometry=list_item_26, Center=list_item_11, Factor=number_slider_3)  # -> Geometry, Transform

offset_surface_27 = OffsetSurface(Surface=scale_16.Geometry, Distance=Slider(0.15, range=0.1..1.1), BothSides=True, CreateSolid=True)

custom_preview_12 = CustomPreview(Geometry=[offset_surface_23, offset_surface_25, offset_surface_27], Material=create_material_2)

屋顶梁大小参数_3 = 层数()
scale_17 = Scale(Geometry=move_6.Geometry, Center=list_item_11, Factor=number_slider_8)  # -> Geometry, Transform
unit_z_27 = UnitZ(Factor=expr("x*1", Slider(0.5, range=0.1..1.1)))
move_38 = Move(Geometry=scale_17.Geometry, Motion=unit_z_27)  # -> Geometry, Transform
ruled_surface_5 = RuledSurface(CurveA=scale_17.Geometry, CurveB=move_38.Geometry)

split_brep_multiple_6 = SplitBrepMultiple(Brep=ruled_surface_5, Cutters=flatten(scale_6.Geometry))
area_6 = Area(Geometry=split_brep_multiple_6)  # -> Area, Centroid
sort_list_6 = SortList(Keys=area_6.Area, ValuesValuesA=split_brep_multiple_6)  # -> Keys, ValuesValuesA
list_item_27 = ListItem(List=sort_list_6.ValuesValuesA, Index=2, Wrap=True)
scale_18 = Scale(Geometry=list_item_27, Center=list_item_11, Factor=number_slider_3)  # -> Geometry, Transform

offset_surface_28 = OffsetSurface(Surface=scale_18.Geometry, Distance=0.2, BothSides=True, CreateSolid=True)

custom_preview_13 = CustomPreview(Geometry=[offset_surface_26, offset_surface_28, offset_surface_24], Material=create_material_8)
